# Grasshopper definition Exercise04_C#Introduction_SECG.gh (Grasshopper 1.0.4)

# ----
# Addition
number_slider = Slider(4.25, range=0..10)
number_slider_2 = Slider(4.11, range=0..10)
c_script = CSharpScript(A=number_slider, B=number_slider_2)  # -> out, R; inputs A: Double, B: Double
# ---------- c_script: C# ----------
    // Here we write our awesome code
    double sum = A + B;

    //Output

    R = sum;
# ---------- end c_script ----------
python = GhPythonScript(A=number_slider, B=number_slider_2)  # -> out, R
# ---------- python: Python ----------
__author__ = "Usuario Dell"
__version__ = "2020.04.24"

import rhinoscriptsyntax as rs

#Here write our awesome code
R = A + B

#Output
print(R)
# ---------- end python ----------
addition = Addition(A=number_slider, B=number_slider_2)
panel = Panel(addition)
panel_2 = Panel(c_script.R)
panel_3 = Panel(python.R)

number_slider_3 = Slider(0, range=0..10)
# List_Item
panel_4 = Panel("""0
10
20
30
40""")
toggle = BooleanToggle(True)
c_script_2 = CSharpScript(L=panel_4, i=number_slider_3, W=toggle)  # -> out, iOut; inputs L: list, i: Int32, W: Boolean
# ---------- c_script_2: C# ----------
    int pos = i;
    if (pos >= L.Count){
      if(W){
        pos = i % L.Count;
      }
      else {
        Component.AddRuntimeMessage(GH_RuntimeMessageLevel.Warning, "Supply index is too high");
        return;
      }
    }

    object datum = L[pos];

    iOut = datum;
# ---------- end c_script_2 ----------
python_2 = GhPythonScript(L=panel_4, i=number_slider_3, W=toggle)  # -> out, iOut; inputs L: list, i: Int32, W: Boolean
# ---------- python_2: Python ----------
__author__ = "Usuario Dell"
__version__ = "2020.04.25"

import rhinoscriptsyntax as rs
import Grasshopper.Kernel as gh

pos = i
e = gh.GH_RuntimeMessageLevel.Error

if (pos >= len(L)):
    if W == True:
        pos = i % len(L)
    else:
        def foo():
            ghenv.Component.AddRuntimeMessage(e, 'Supply is too high')
            return

datum = L[pos]

iOut = datum
print(datum)
# ---------- end python_2 ----------
item = ListItem(List=panel_4, Index=number_slider_3, Wrap=toggle)
panel_5 = Panel(item)
panel_6 = Panel(c_script_2.iOut)
panel_7 = Panel(python_2.iOut)

# ----
# Construct_Point
number_slider_4 = Slider(2.55, range=0..10)
number_slider_5 = Slider(4.09, range=0..10)
number_slider_6 = Slider(4.87, range=0..10)
c_script_3 = CSharpScript(X=number_slider_4, Y=number_slider_6, Z=number_slider_5)  # -> out, Pt; inputs X: Double, Y: Double, Z: Double
# ---------- c_script_3: C# ----------
    Point3d p = new Point3d(X, Y, Z);

    Pt = p;
# ---------- end c_script_3 ----------
python_3 = GhPythonScript(X=number_slider_4, Y=number_slider_6, Z=number_slider_5)  # -> out, Pt
# ---------- python_3: Python ----------
__author__ = "Usuario Dell"
__version__ = "2020.04.25"

import rhinoscriptsyntax as rs

p = rs.AddPoint(X, Y, Z)

Pt = p

print(Pt)
# ---------- end python_3 ----------
pt = ConstructPoint(XCoordinate=number_slider_4, YCoordinate=number_slider_6, ZCoordinate=number_slider_5)
panel_9 = Panel(pt)
panel_10 = Panel(c_script_3.Pt)
panel_11 = Panel(python_3.Pt)
c_script_4 = CSharpScript(p=c_script_3.Pt)  # -> out, X, Y, Z; inputs p: Point3d
# ---------- c_script_4: C# ----------
    X = p.X;
    Y = p.Y;
    Z = p.Z;
# ---------- end c_script_4 ----------
python_4 = GhPythonScript(p=python_3.Pt)  # -> out, X, Y, Z; inputs p: Point3d
# ---------- python_4: Python ----------
__author__ = "Usuario Dell"
__version__ = "2020.04.25"

import rhinoscriptsyntax as rs

X = p.X
Y = p.Y
Z = p.Z
# ---------- end python_4 ----------
pdecon = Deconstruct(Point=pt)  # -> XComponent, YComponent, ZComponent
panel_12 = Panel(pdecon.XComponent)
panel_13 = Panel(pdecon.YComponent)
panel_14 = Panel(pdecon.ZComponent)
panel_15 = Panel(c_script_4.X)
panel_16 = Panel(c_script_4.Y)
panel_17 = Panel(c_script_4.Z)
panel_18 = Panel(python_4.X)
panel_19 = Panel(python_4.Y)
panel_20 = Panel(python_4.Z)

# ----
# Series
number_slider_7 = Slider(1, range=0..10)
number_slider_8 = Slider(1.919, range=-10..10)
number_slider_9 = Slider(7, range=0..10)
c_script_5 = CSharpScript(S=number_slider_7, N=number_slider_8, C=number_slider_9)  # -> out, SOut; inputs S: Double, N: Double, C: Int32
# ---------- c_script_5: C# ----------
/*
    List<double> nums = new List<double>();

    for ( int i = 0; i < C; i++){
      double val = S + N * i;
      nums.Add(val);
    }*/
    double[] nums = new double[C];
    for (int i = 0; i < C; i++) {
      double val = S + N * i;
      nums[i] = val;

    }
    SOut = nums;
# ---------- end c_script_5 ----------
python_5 = GhPythonScript(S=number_slider_7, N=number_slider_8, C=number_slider_9)  # -> out, SOut; inputs C: Int32
# ---------- python_5: Python ----------
__author__ = "Usuario Dell"
__version__ = "2020.04.25"

import rhinoscriptsyntax as rs

SOut = []
SOut.append(S)


for i in range(1,C):
    val = S+N*i
    SOut.append(val)
# ---------- end python_5 ----------
series = Series(Start=number_slider_7, Step=number_slider_8, Count=number_slider_9)
panel_21 = Panel(c_script_5.SOut)
panel_22 = Panel(series)
panel_23 = Panel(python_5.SOut)

# ----
# Vector_Dot_Product/Vector_Cross_Product
number_slider_10 = Slider(3.96, range=0..10)
# Vector_Length
number_slider_11 = Slider(7.21, range=0..10)
vec = VectorXYZ(XComponent=number_slider_11, YComponent=Slider(4.36, range=0..10), ZComponent=number_slider_10)  # -> Vector, Length
c_script_6 = CSharpScript(V=vec.Vector)  # -> out, L; inputs V: Vector3d
# ---------- c_script_6: C# ----------
    //double len = Math.Sqrt(V.X * V.X + V.Y * V.Y + V.Z * V.Z);

    double len = V.Length;

    L = len;
# ---------- end c_script_6 ----------
python_6 = GhPythonScript(V=vec.Vector)  # -> out, L; inputs V: Vector3d
# ---------- python_6: Python ----------
__author__ = "Usuario Dell"
__version__ = "2020.04.25"

import rhinoscriptsyntax as rs

len = V.Length
print(len)

L = len
# ---------- end python_6 ----------
vlen = VectorLength(Vector=vec.Vector)
panel_24 = Panel(vlen)
panel_25 = Panel(c_script_6.L)
panel_26 = Panel(python_6.L)

vec_2 = VectorXYZ(XComponent=Slider(2.1, range=0..10), YComponent=Slider(5.68, range=0..10), ZComponent=Slider(7.88, range=0..10))  # -> Vector, Length
vec_3 = VectorXYZ(XComponent=Slider(1.46, range=0..10), YComponent=Slider(6.32, range=0..10), ZComponent=Slider(7.07, range=0..10))  # -> Vector, Length
toggle_2 = BooleanToggle(False)
toggle_3 = BooleanToggle(False)
c_script_7 = CSharpScript(A=vec_3.Vector, B=vec_2.Vector, U=toggle_2)  # -> out, D; inputs A: Vector3d, B: Vector3d, U: Boolean
# ---------- c_script_7: C# ----------
    if (U) {
      A.Unitize();
      B.Unitize();
    }
    //double dot = A.X * B.X + A.Y * B.Y + A.Z * B.Z;
    //double dot = A * B;

    double dot = Vector3d.Multiply(A, B);



    D = dot;
# ---------- end c_script_7 ----------
python_7 = GhPythonScript(A=vec_3.Vector, B=vec_2.Vector, U=toggle_2)  # -> out, D; inputs A: Vector3d, B: Vector3d, U: Boolean
# ---------- python_7: Python ----------
__author__ = "Usuario Dell"
__version__ = "2020.04.25"

import rhinoscriptsyntax as rs

if(U):
    A.Unitize()
    B.Unitize()

dot = rs.VectorDotProduct(A,B)
D = dot
# ---------- end python_7 ----------
dprod = DotProduct(VectorA=vec_3.Vector, VectorB=vec_2.Vector, Unitize=toggle_2)
python_8 = GhPythonScript(A=vec_3.Vector, B=vec_2.Vector, U=toggle_3)  # -> out, V, L; inputs A: Vector3d, B: Vector3d, U: Boolean
# ---------- python_8: Python ----------
__author__ = "Usuario Dell"
__version__ = "2020.04.25"

import rhinoscriptsyntax as rs

if(U):
    A.Unitize()
    B.Unitize()

cross = rs.VectorCrossProduct(A, B)

V = cross
L = rs.VectorLength(cross)
# ---------- end python_8 ----------
c_script_8 = CSharpScript(A=vec_3.Vector, B=vec_2.Vector, U=toggle_3)  # -> out, V, L; inputs A: Vector3d, B: Vector3d, U: Boolean
# ---------- c_script_8: C# ----------
    if(U){
      A.Unitize();
      B.Unitize();
    }

    Vector3d cross = Vector3d.CrossProduct(A, B);

    V = cross;
    L = cross.Length;
# ---------- end c_script_8 ----------
xprod = CrossProduct(VectorA=vec_3.Vector, VectorB=vec_2.Vector, Unitize=toggle_3)  # -> Vector, Length
panel_27 = Panel(dprod)
panel_28 = Panel(c_script_7.D)
panel_29 = Panel(python_7.D)
panel_30 = Panel([xprod.Vector, xprod.Length])
panel_31 = Panel([c_script_8.V, c_script_8.L])
panel_32 = Panel([python_8.V, python_8.L])

# ----
# Line
number_slider_12 = Slider(7.24, range=0..10)
pt_2 = ConstructPoint(XCoordinate=number_slider_12, YCoordinate=Slider(2.21, range=0..10), ZCoordinate=Slider(2.08, range=0..10))
pt_3 = ConstructPoint(XCoordinate=Slider(0, range=0..10), YCoordinate=Slider(10, range=0..10), ZCoordinate=Slider(3.23, range=0..10))
c_script_9 = CSharpScript(A=pt_2, B=pt_3)  # -> out, L; inputs A: Point3d, B: Point3d
# ---------- c_script_9: C# ----------
    Line line = new Line(A, B);

    L = line;
# ---------- end c_script_9 ----------
python_9 = GhPythonScript(A=pt_2, B=pt_3)  # -> out, L; inputs A: Point3d, B: Point3d
# ---------- python_9: Python ----------
__author__ = "Usuario Dell"
__version__ = "2020.04.25"

import rhinoscriptsyntax as rs

line = rs.AddLine(A, B)
L = line
# ---------- end python_9 ----------
ln = Line(StartPoint=pt_2, EndPoint=pt_3)

# ----
# Range
number_slider_13 = Slider(0.16, range=0..1)
number_slider_14 = Slider(7, range=0..10)
dom = ConstructDomain(DomainStart=number_slider_13, DomainEnd=Slider(6.07, range=0..10))
c_script_10 = CSharpScript(D=dom, N=number_slider_14)  # -> out, R; inputs N: Int32
# ---------- c_script_10: C# ----------
    double step = D.Length / N;
    Print("step size" + step);

    List<double> nums = new List<double>();
    for (int i = 0; i <= N; i++) {
      double val = D.T0 + step * i;
      nums.Add(val);
    }
    R = nums;
# ---------- end c_script_10 ----------
range = Range(Domain=dom, Steps=number_slider_14)
panel_33 = Panel(range)
panel_34 = Panel(c_script_10.R)

python_10 = GhPythonScript(D=dom, N=number_slider_14)  # -> out, R; inputs N: Int32
# ---------- python_10: Python ----------
__author__ = "Usuario Dell"
__version__ = "2020.04.25"

import rhinoscriptsyntax as rs

Va = D.T0
#print(Va)

Vb = D.T1
#print(Vb)

Vc = Vb - Va
#print(Vc)

step = Vc / N
#print(step)

R = []
print('step size',  step)

for num in range(0, (N+1)):
    val = D.T0 + step * num
    print(val)
    R.append(val)
# ---------- end python_10 ----------
panel_35 = Panel(c_script_10.out)

panel_36 = Panel(python_10.out)
panel_37 = Panel(python_10.R)
