# Grasshopper definition Exercise05_C#Introduction_SECG.gh (Grasshopper 1.0.4)

toggle = BooleanToggle(False)
number_slider = Slider(3, range=0..10)
number_slider_2 = Slider(2, range=0..10)
# Interpolate
pt = Point([Point(7.943237848, 8.549157494, 0), Point(13.67913933, 19.4720035, 0), Point(26.1376465, 8.907125166, 0), Point(38.05886199, 13.54353912, 0)])
c_script = CSharpScript(V=pt, D=number_slider, P=toggle, K=number_slider_2)  # -> out, C, L, DOut; inputs V: list of Point3d, D: Int32, P: Boolean, K: Int32
# ---------- c_script: C# ----------
    int knotStyle = K;
    if (P) {
      knotStyle += 3;
    }
    CurveKnotStyle style = (CurveKnotStyle) knotStyle;
    Curve c = Curve.CreateInterpolatedCurve(V, D, style);

    double curveLength = c.GetLength();

    Interval dom = c.Domain;

    //Outputs
    C = c;
    L = curveLength;
    DOut = dom;
# ---------- end c_script ----------
python = GhPythonScript(V=pt, D=number_slider, P=toggle, K=number_slider_2)  # -> out, C, L, DOut; inputs V: list of Point3d, D: Int32, P: Boolean, K: Int32
# ---------- python: Python ----------
__author__ = "Usuario Dell"
__version__ = "2020.05.02"

import rhinoscriptsyntax as rs

knotStyle = K
dg = D

if (P):
    knotStyle += 3

points = V
C = rs.AddInterpCurve(points, dg, knotStyle)
L = rs.CurveLength(C)
print(L)
DOut = rs.CurveDomain(C)
# ---------- end python ----------
intcrv = Interpolate(Vertices=pt, Degree=number_slider, Periodic=toggle, KnotStyle=number_slider_2)  # -> Curve, Length, Domain
panel = Panel([intcrv.Curve, intcrv.Length, intcrv.Domain])
panel_2 = Panel([c_script.C, c_script.L, c_script.DOut])
panel_3 = Panel([python.C, python.L, python.DOut])

number_slider_3 = Slider(10, range=0..10)
toggle_2 = BooleanToggle(False)
c_script_2 = CSharpScript(C=c_script.C, N=number_slider_3, A=toggle_2)  # -> out, F, t; inputs C: Curve, N: Int32, A: Boolean
# ---------- c_script_2: C# ----------
    double [] tValues;
    Plane[] planes;

    if(A) {
      tValues = C.DivideByCount(N, true);
      planes = C.GetPerpendicularFrames(tValues);
    }
    else {
      Point3d[] pts;
      tValues = C.DivideByCount(N, true, out pts);
      planes = new Plane [tValues.Length];
      for (int i = 0; i < tValues.Length; i++) {
        Vector3d tan = C.TangentAt(tValues[i]);
        Plane pl = new Plane(pts[i], tan);
        planes[i] = pl;
      }
    }

    F = planes;
    t = tValues;
# ---------- end c_script_2 ----------
python_2 = GhPythonScript(C=python.C, N=number_slider_3, A=toggle_2)  # -> out, F, t; inputs C: Curve, N: Int32, A: Boolean
# ---------- python_2: Python ----------
__author__ = "Usuario Dell"
__version__ = "2020.05.02"

import rhinoscriptsyntax as rs

tValues = []
planes = []

if (A):
    tValues = C.DivideByCount(N, True)
#    print(tValues)
    planes = C.GetPerpendicularFrames(tValues)
#    print(planes)
else:
    pts = []
    tValues = C.DivideByCount(N, True)
    planes = len(tValues)
    for i in range(0, planes):
        tan = C.TangentAt(tValues[i])
        pl = i , tan
        planes = C.GetPerpendicularFrames(tValues)
F = planes
t = tValues
# ---------- end python_2 ----------
# PerpFrames
pframes = PerpFrames(Curve=intcrv.Curve, Count=number_slider_3, Align=toggle_2)  # -> Frames, Parameters
panel_4 = Panel(pframes.Frames)
panel_5 = Panel(c_script_2.F)
panel_6 = Panel(python_2.F)
panel_7 = Panel(pframes.Parameters)
panel_8 = Panel(c_script_2.t)
panel_9 = Panel(python_2.t)

pt_2 = ConstructPoint(XCoordinate=Slider(5, range=0..100), YCoordinate=Slider(9, range=0..100), ZCoordinate=0)

toggle_3 = BooleanToggle(False)
number_slider_4 = Slider(0, range=0..6)
crv = Curve([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])
c_script_3 = CSharpScript(C=crv, Cls=toggle_3, T=number_slider_4)  # -> out, L; inputs C: list of Curve, Cls: Boolean, T: Int32
# ---------- c_script_3: C# ----------
    LoftType ltype = (LoftType) T;
    Brep[] surf = Brep.CreateFromLoft(C, Point3d.Unset, Point3d.Unset, ltype, Cls);

    L = surf;
# ---------- end c_script_3 ----------
python_3 = GhPythonScript(C=crv, Cls=toggle_3, T=number_slider_4)  # -> out, L; inputs C: list
# ---------- python_3: Python ----------
__author__ = "Usuario Dell"
__version__ = "2020.05.02"

import rhinoscriptsyntax as rs

L = rs.AddLoftSrf(C, None, None, T, 0, 0, Cls)
# ---------- end python_3 ----------
# Loft
loft = Loft(Curves=crv, Options={Adjust=False, Closed=False, LoftEnds=0, LoftSimp=0, LoftType=0, Rebuild=10, Refit=0.01})
c_script_4 = CSharpScript(S=c_script_3.L, uv=pt_2)  # -> out, P, N, U, V, F; inputs S: Surface, uv: Point3d
# ---------- c_script_4: C# ----------
    Point3d point;
    Vector3d[] derivatives;
    bool evalSucces = S.Evaluate(uv.X, uv.Y, 1, out point, out derivatives);

    Vector3d normal = S.NormalAt(uv.X, uv.Y);

    Plane frame;
    bool frameSuccessful = S.FrameAt(uv.X, uv.Y, out frame);



    //Output
    P = point;
    N = normal;
    U = derivatives[0];
    V = derivatives[1];
    F = frame;
# ---------- end c_script_4 ----------
python_4 = GhPythonScript(S=python_3.L, uv=pt_2)  # -> out, P, N, U, V, F; inputs S: Surface, uv: Point3d
# ---------- python_4: Python ----------
__author__ = "Usuario Dell"
__version__ = "2020.05.02"

import rhinoscriptsyntax as rs

point = rs.EvaluateSurface(S, uv.X, uv.Y)
evalSucces = S.Evaluate(uv.X, uv.Y, 1)


normal = S.NormalAt(uv.X, uv.Y)
param = rs.SurfaceEvaluate(S, uv, 1)



frameSuccessful = S.FrameAt(uv.X, uv.Y)
frame = frameSuccessful[1]



#Output 
P = point
N = normal
U = param[1]
V = param[2]
F = frame
# ---------- end python_4 ----------
evalsrf = EvaluateSurface(Surface=loft, Point=pt_2)  # -> Point, Normal, UDirection, VDirection, Frame
panel_10 = Panel([evalsrf.Point, evalsrf.Normal, evalsrf.UDirection, evalsrf.VDirection, evalsrf.Frame])
panel_11 = Panel([c_script_4.P, c_script_4.N, c_script_4.U, c_script_4.V, c_script_4.F])
panel_12 = Panel([python_4.P, python_4.N, python_4.U, python_4.V, python_4.F])

number_slider_5 = Slider(6.588, range=0..20)
c_script_5 = CSharpScript(C=c_script.C, t=number_slider_5)  # -> out, P, T, A; inputs C: Curve, t: Double
# ---------- c_script_5: C# ----------
    Interval dom = C.Domain;
    bool isInsideDomain = dom.IncludesParameter(t);
    if(!isInsideDomain) {
      Component.AddRuntimeMessage(GH_RuntimeMessageLevel.Warning, "Outside domain!!!");
    }

    Point3d p = C.PointAt(t);
    Vector3d tangent = C.TangentAt(t);

    //OutPuts
    P = p;
    T = tangent;
# ---------- end c_script_5 ----------
python_5 = GhPythonScript(C=python.C, t=number_slider_5)  # -> out, P, T, A; inputs C: Curve
# ---------- python_5: Python ----------
__author__ = "Usuario Dell"
__version__ = "2020.05.02"

import rhinoscriptsyntax as rs
import Grasshopper.Kernel as gh

w = gh.GH_RuntimeMessageLevel.Warning

dom = rs.CurveDomain(C)
#print(dom)

isInsideDomain = dom.IncludesParameter(t)
#print(isInsideDomain)

if(isInsideDomain != True):
    ghenv.Component.AddRuntimeMessage(w,'this is a warning')

p = C.PointAt(t)
tangent = C.TangentAt(t);

P = p
T = tangent
# ---------- end python_5 ----------
# EvaluateCurve
eval = EvaluateCurve(Curve=intcrv.Curve, Parameter=number_slider_5)  # -> Point, Tangent, Angle
panel_13 = Panel([eval.Point, eval.Tangent, eval.Angle])
panel_14 = Panel([python_5.P, python_5.T, python_5.A])
panel_15 = Panel([c_script_5.P, c_script_5.T, c_script_5.A])

c_script_6 = CSharpScript(P=pt_2, S=c_script_3.L)  # -> out, POut, uvP, D; inputs P: Point3d, S: Surface
# ---------- c_script_6: C# ----------
    double u, v;
    bool success = S.ClosestPoint(P, out u, out v);

    Point3d point;
    Vector3d[] derivatives;
    S.Evaluate(u, v, 1, out point, out derivatives);

    double d = point.DistanceTo(P);

    //Outputs
    POut = point;
    uvP = new Point3d(u, v, 0);
    D = d;
# ---------- end c_script_6 ----------
python_6 = GhPythonScript(P=pt_2, S=python_3.L)  # -> out, POut, uvP, D; inputs P: Point3d, S: Surface
# ---------- python_6: Python ----------
__author__ = "Usuario Dell"
__version__ = "2020.05.02"

import rhinoscriptsyntax as rs

success = rs.SurfaceClosestPoint(S, P)

u = success[0]
v = success[1]

su = u, v




sc = S.Evaluate(u, v, 1)
point = sc[1]

d  = point.DistanceTo(P) 



POut = point
uvP = rs.AddPoint(success)
D = d
# ---------- end python_6 ----------
# SurfaceClosestPoint
srf_cp = SurfaceClosestPoint(Point=pt_2, Surface=loft)  # -> Point, UVPoint, Distance
panel_16 = Panel([srf_cp.Point, srf_cp.UVPoint, srf_cp.Distance])
panel_17 = Panel([python_6.POut, python_6.uvP, python_6.D])
panel_18 = Panel([c_script_6.POut, c_script_6.uvP, c_script_6.D])

number_slider_6 = Slider(10, range=0..10)
toggle_4 = BooleanToggle(False)
c_script_7 = CSharpScript(C=c_script.C, N=number_slider_6, K=toggle_4)  # -> out, P, T, t; inputs C: Curve, N: Int32, K: Boolean
# ---------- c_script_7: C# ----------
    Point3d[] pts;
    double[] tValues = C.DivideByCount(N, true, out pts);

    List<Vector3d> tangents = new List<Vector3d>();
    for (int i = 0; i < tValues.Length; i++) {
      double param = tValues[i];
      Vector3d tan = C.TangentAt(param);
      tangents.Add(tan);
    }
    //Outputs
    P = pts;
    T = tangents;
    t = tValues;
# ---------- end c_script_7 ----------
python_7 = GhPythonScript(C=python.C, N=number_slider_6, K=toggle_4)  # -> out, P, T, t; inputs C: Curve, N: Int32, K: Boolean
# ---------- python_7: Python ----------
__author__ = "Usuario Dell"
__version__ = "2020.05.02"

import rhinoscriptsyntax as rs

pts = []
tValues = C.DivideByCount(N, True)
tangents = []

for i in range(0, len(tValues)):
    param = tValues[i]
    tan = C.TangentAt(param)
    tangents.append(tan)

pts= rs.DivideCurve(C, N, K)

P = pts
t = tValues
T = tangents
# ---------- end python_7 ----------
divide = DivideCurve(Curve=intcrv.Curve, Count=number_slider_6, Kinks=toggle_4)  # -> Points, Tangents, Parameters
panel_19 = Panel(c_script_7.P)
# DivideCurve
panel_20 = Panel(divide.Points)
panel_21 = Panel(python_7.P)
panel_22 = Panel(divide.Tangents)
panel_23 = Panel(c_script_7.T)
panel_24 = Panel(python_7.T)
panel_25 = Panel(divide.Parameters)
panel_26 = Panel(c_script_7.t)
panel_27 = Panel(python_7.t)
