# Grasshopper definition LiveStream06_Exercise01_C#Introduction.gh (Grasshopper 1.0.4)

pt = Point(Point(3, 8, 0))
pt_2 = Point(Point(12, 3, 0))
pt_3 = Point(Point(10, 11, 0))
ln = Line(StartPoint=pt, EndPoint=pt_2)
crv_cp = CurveClosestPoint(Point=pt_3, Curve=ln)  # -> Point, Parameter, Distance

c_script = CSharpScript(P=pt_3, A=pt, B=pt_2)  # -> out, D; inputs P: Point3d, A: Point3d, B: Point3d
# ---------- c_script: C# ----------
    D = distToLineDotProduct(P, A, B);
# ---------- c_script: C# additional code ----------
  double distToLineDotProduct(Point3d P, Point3d A, Point3d B){

    Vector3d AB = B - A;
    AB.Unitize();
    Vector3d AP = P - A;

    double cross = AP * AB; // length for the projection
    double lengthAP = AP.Length;

    double h = Math.Sqrt(lengthAP * lengthAP - (cross * cross));

    return h;
  }
# ---------- end c_script ----------
c_script_2 = CSharpScript(P=pt_3, A=pt, B=pt_2)  # -> out, DDot, DCross; inputs P: Point3d, A: Point3d, B: Point3d
# ---------- c_script_2: C# ----------
    DDot = distToLineDotProduct(P, A, B);

    DCross = distToLineCrossProduct(P, A, B);
# ---------- c_script_2: C# additional code ----------
  double distToLineDotProduct(Point3d P, Point3d A, Point3d B){

    Vector3d AB = B - A;
    AB.Unitize();
    Vector3d AP = P - A;

    double cross = AP * AB; // length for the projection
    double lengthAP = AP.Length;

    double h = Math.Sqrt(lengthAP * lengthAP - (cross * cross));

    return h;
  }

  double distToLineCrossProduct(Point3d P, Point3d A, Point3d B){
    Vector3d AB = B - A;
    Vector3d AP = P - A;

    Vector3d cross = Vector3d.CrossProduct(AB, AP);
    double lengthCross = cross.Length;
    double lengthAB = AB.Length;

    double h = lengthCross / lengthAB;

    return h;
  }
# ---------- end c_script_2 ----------
# DotProduct_CrossProduct
c_script_3 = CSharpScript(P=pt_3, A=pt, B=pt_2)  # -> out, DDot, DCross; inputs P: Point3d, A: Point3d, B: Point3d
# ---------- c_script_3: C# ----------
    DDot = distToLineDotProduct(P, A, B);

    DCross = distToLineCrossProduct(P, A, B);
# ---------- c_script_3: C# additional code ----------
  double distToLineDotProduct(Point3d P, Point3d A, Point3d B){

    Vector3d AB = B - A;
    AB.Unitize();
    Vector3d AP = P - A;

    double dot = dotProduct(AP, AB); // length for the projection
    double lengthAP = AP.Length;

    double h = Math.Sqrt(lengthAP * lengthAP - (dot * dot));

    return h;
  }

  double distToLineCrossProduct(Point3d P, Point3d A, Point3d B){
    Vector3d AB = B - A;
    Vector3d AP = P - A;

    Vector3d cross = crossProduct(AB, AP);
    double lengthCross = cross.Length;
    double lengthAB = AB.Length;

    double h = lengthCross / lengthAB;

    return h;
  }

  double dotProduct(Vector3d u, Vector3d v) {
    return u.X * v.X + u.Y * v.Y + u.Z * v.Z;
  }

  Vector3d crossProduct(Vector3d u, Vector3d v) {
    double x = u.Y * v.Z - u.Z * v.Y;
    double y = u.Z * v.Y - u.X * v.Z;
    double z = u.X * v.Y - u.Y * v.X;

    return new Vector3d(x, y, z);
  }
# ---------- end c_script_3 ----------
panel = Panel(c_script.D)
panel_2 = Panel([c_script_2.DDot, c_script_2.DCross])
panel_3 = Panel([c_script_3.DDot, c_script_3.DCross])

panel_4 = Panel(crv_cp.Distance)

python = GhPythonScript(P=pt_3, A=pt, B=pt_2)  # -> out, DDot, DCross; inputs P: Point3d, A: Point3d, B: Point3d
# ---------- python: Python ----------
__author__ = "Usuario Dell"
__version__ = "2020.05.09"

import rhinoscriptsyntax as rs
import math


#DDot--DotProduct

def distToLineDotProduct(p, a, b):
    ab = b-a
    ab.Unitize()
    c = ab.Unitize()
    Ap = p - a
    cross = Ap * ab
    lengthAp = Ap.Length
    h = math.sqrt(lengthAp * lengthAp - (cross * cross))
    return h



DDot = distToLineDotProduct(P, A, B)

#DCross--CrossProduct
AB = B - A
AP = P- A
cross = rs.VectorCrossProduct(AB, AP)
lengthCross = cross.Length
lengthAB = AB.Length

v = lengthCross / lengthAB
DCross = v
# ---------- end python ----------
python_2 = GhPythonScript(P=pt_3, A=pt, B=pt_2)  # -> out, DDot, DCross; inputs P: Point3d, A: Point3d, B: Point3d
# ---------- python_2: Python ----------
__author__ = "Usuario Dell"
__version__ = "2020.05.09"

import rhinoscriptsyntax as rs
import math


#DDot--DotProduct

def distToLineDotProduct(p, a, b):
    ab = b-a
    ab.Unitize()
    c = ab.Unitize()
    Ap = p - a
    
    dot = dotProduct(Ap, ab)
    lengthAp = Ap.Length
    h = math.sqrt(lengthAp * lengthAp - (dot * dot))
    return h

def dotProduct(u,v):
    return u.X * v.X + u.Y * v.Y + u.Z * v.Z

DDot = distToLineDotProduct(P, A, B)



#DCross--CrossProduct


def crossProduct(u, v): 
    x = u.Y * v.Z - u.Z * v.Y
    y = u.Z * v.Y - u.X * v.Z
    z = u.X * v.Y - u.Y * v.X
    return rs.CreateVector(x, y, z)


AB = B - A
AP = P- A

cross = crossProduct(AB, AP)
lengthCross = cross.Length
lengthAB = AB.Length

vec = lengthCross / lengthAB
DCross = vec
# ---------- end python_2 ----------
python_3 = GhPythonScript(P=pt_3, A=pt, B=pt_2)  # -> out, D; inputs P: Point3d, A: Point3d, B: Point3d
# ---------- python_3: Python ----------
__author__ = "Usuario Dell"
__version__ = "2020.05.09"

import rhinoscriptsyntax as rs
import math

p= P
print(p)

a = A
print(a)

b = B
print(b)



def distToLineDotProduct(p, a, b):
    ab = b-a
    ab.Unitize()
    c = ab.Unitize()
    Ap = p - a
    cross = Ap * ab
    lengthAp = Ap.Length
    print(lengthAp)
    h = math.sqrt(lengthAp * lengthAp - (cross * cross))
    return h



D = distToLineDotProduct(P, A, B)
# ---------- end python_3 ----------
panel_5 = Panel(python_3.D)
panel_6 = Panel([python.DDot, python.DCross])
# DotProduct_CrossProduct
panel_7 = Panel([python_2.DDot, python_2.DCross])
python_4 = GhPythonScript(P=pt_3, A=pt, B=pt_2)  # -> out, DDot, DCross; inputs P: Point3d, A: Point3d, B: Point3d
# ---------- python_4: Python ----------
__author__ = "Usuario Dell"
__version__ = "2020.05.09"

import rhinoscriptsyntax as rs
import math


#Variables
AB = B - A
AP = P - A


#DDot--DotProduct
AB.Unitize()
c = AB.Unitize()
cr = AP * AB
lengthAP = AP.Length
h = math.sqrt(lengthAP * lengthAP - (cr * cr))

#DCross--CrossProduct
cross = rs.VectorCrossProduct(AB, AP)
lengthCross = cross.Length
lengthAB = AB.Length
v = lengthCross / lengthAB

DDot = h
DCross = v
# ---------- end python_4 ----------
panel_8 = Panel([python_4.DDot, python_4.DCross])
