# Grasshopper definition AM_004_VisualizingMotion_Python_01.gh (Grasshopper 1.0.7)

panel = Panel("C:\Users\JLX\Desktop\csv\motion_01.csv")
panel_2 = Panel("C:\Users\JLX\Desktop\csv\motion_02.csv")

# ----
# motion_01a.csv file
path = FilePath("C:\Users\Usuario Dell\Documents\IOKAN\PLearning\Rhino_GH\ComputationalDesignLiveStreamJoseDelCastillo\CodingGems\motion_01a.csv")
panel_3 = Panel(path)
python = GhPythonScript(csvPath=path)  # -> out, Timestamps, T0Planes, T0TriggerPressed, T0TriggerClicked, T0TriggerValues, T0TouchpadPressed, T0TouchpadClicked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
# ---------- python: Python ----------
__author__ = "Usuario Dell"
__version__ = "2021.01.18"

import rhinoscriptsyntax as rs
import csv 
import System.Convert as convert
import Rhino






#Variable Declaration and Casting Type
data = open(csvPath)
csvLine = csv.reader(data)

#Build a right list to be sorted by any Field

a = []
for i in data:
    splitData = i.split(',')
    for j in splitData:
        splitA = j.rsplit(',')
    a.append(splitData)


csvLines = a[1:]

#check first and las Item
#print(csvLines[0], csvLines[-1])

#OUTPUTS
Timestamps = []

#CONTROLLER info
T0Planes = []
T0TriggerPressed = []
T0TriggerClicked = []
T0TriggerValues = []
T0TouchpadPressed = []
T0TouchpadClicked = []
T0TouchpadValues = []


#CONTROLLER info
T1Planes = []
T1TriggerPressed = []
T1TriggerClicked = []
T1TriggerValues = []
T1TouchpadPressed = []
T1TouchpadClicked = []
T1TouchpadValues = []


for rowData in csvLines:
    #TIMESTAMPS
    Timestamps.append(convert.ToInt64(rowData[0]))
    
    #CONTROLLER 0
    #ORIGIN_0
    x0 = float(rowData[1])
    y0 = float(rowData[2])
    z0 = float(rowData[3])
    origin0 = Rhino.Geometry.Point3d(x0, y0, z0)
    
    #XAxis0
    xAx0 = float(rowData[4])
    yAx0 = float(rowData[5])
    zAx0 = float(rowData[6])
    xAxis0 = Rhino.Geometry.Vector3d(xAx0, yAx0, zAx0)
    
    #YAxis0
    xAy0 = float(rowData[7])
    yAy0 = float(rowData[8])
    zAy0 = float(rowData[9])
    yAxis0 = Rhino.Geometry.Vector3d(xAy0, yAy0, zAy0)
    
    #CONTROLLER 0 PLANE
    pl0 = Rhino.Geometry.Plane(origin0, xAxis0, yAxis0)
    T0Planes.append(pl0)
    
    #TRIGGERS 0
    T0TriggerPressed.append(convert.ToBoolean(rowData[10]))
    T0TriggerClicked.append(convert.ToBoolean(rowData[11]))
    T0TriggerValues.append(convert.ToDouble(rowData[12]))
    
    #TOUCHPAD 0
    T0TouchpadPressed.append(convert.ToBoolean(rowData[13]))
    T0TouchpadClicked.append(convert.ToBoolean(rowData[14]))
    xT0pad = convert.ToDouble(rowData[15])
    yT0pad = convert.ToDouble(rowData[16])
    T0TouchpadValues.append(Rhino.Geometry.Vector3d(xT0pad, yT0pad, 0))
    
    #CONTROLLER 1
    #ORIGIN_1
    x1 = float(rowData[17])
    y1 = float(rowData[18])
    z1 = float(rowData[19])
    origin1 = Rhino.Geometry.Point3d(x1, y1, z1)
    
    #XAXIS1
    xAx1 = float(rowData[20])
    yAx1 = float(rowData[21])
    zAx1 = float(rowData[22])
    xAxis1 = Rhino.Geometry.Vector3d(xAx1, yAx1, zAx1)
    
    #YAXIS1
    xAy1 = float(rowData[23])
    yAy1 = float(rowData[24])
    zAy1 = float(rowData[25])
    yAxis1 = Rhino.Geometry.Vector3d(xAy1, yAy1, zAy1)
    
    #CONTROLLER 1 PLANE
    pl1 = Rhino.Geometry.Plane(origin1, xAxis1, yAxis1)
    T1Planes.append(pl1)
    
    #TRIGGERS 1
    T1TriggerPressed.append(bool(rowData[26]))
    T1TriggerClicked.append(bool(rowData[27]))
    T1TriggerValues.append(float(rowData[28]))
    
    #TOUCHPAD 1
    T1TouchpadPressed.append(bool(rowData[29]))
    T1TouchpadClicked.append(bool(rowData[30]))
    xT1pad = float(rowData[31])
    yT1pad = float(rowData[32])
    T1TouchpadValues.append(Rhino.Geometry.Vector3d(xT1pad, yT1pad, 0))
# ---------- end python ----------
c_script = CSharpScript(csvPath=path)  # -> out, Timestamps, T0Planes, T0TriggerPressed, T0TriggerClicked, T0TriggerValue, T0TouchpadPressed, T0TouchpadClicked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; inputs csvPath: String
# ---------- c_script: C# ----------
    // Read the contents of the CSV files as individual lines
    string[] csvLines = System.IO.File.ReadAllLines(csvPath);

    // List of timestamps
    var timestamps = new List<long>();

    // List of Controller 0 Data
    var controller0Planes = new List<Plane>();
    var controller0TriggerPressed = new List<bool>();
    var controller0TriggerClicked = new List<bool>();
    var controller0TriggerValue = new List<double>();
    var controller0TouchpadPressed = new List<bool>();
    var controller0TouchpadClicked = new List<bool>();
    var controller0TouchpadValues = new List<Vector3d>();

    // List of Controller 1 Data
    var controller1Planes = new List<Plane>();
    var controller1TriggerPressed = new List<bool>();
    var controller1TriggerClicked = new List<bool>();
    var controller1TriggerValue = new List<double>();
    var controller1TouchpadPressed = new List<bool>();
    var controller1TouchpadClicked = new List<bool>();
    var controller1TouchpadValues = new List<Vector3d>();

    // Parse all lines
    for (int i = 1; i < csvLines.Length; i++) {
      string[] rowData = csvLines[i].Split(',');

      // Tiemstamps
      timestamps.Add(Convert.ToInt64(rowData[0]));

      // CONTROLLER 0
      // ORIGIN
      double x = Convert.ToDouble(rowData[1]);
      double y = Convert.ToDouble(rowData[2]);
      double z = Convert.ToDouble(rowData[3]);
      Point3d origin0 = new Point3d(x, y, z);

      // X AXIS
      x = Convert.ToDouble(rowData[4]);
      y = Convert.ToDouble(rowData[5]);
      z = Convert.ToDouble(rowData[6]);
      Vector3d xAxis0 = new Vector3d(x, y, z);

      // Y AXIS
      x = Convert.ToDouble(rowData[7]);
      y = Convert.ToDouble(rowData[8]);
      z = Convert.ToDouble(rowData[9]);
      Vector3d yAxis0 = new Vector3d(x, y, z);

      // CONTROLLER 0 PLANE
      Plane pl0 = new Plane(origin0, xAxis0, yAxis0);
      controller0Planes.Add(pl0);

      // Triggers
      controller0TriggerPressed.Add(Convert.ToBoolean(rowData[10]));
      controller0TriggerClicked.Add(Convert.ToBoolean(rowData[11]));
      controller0TriggerValue.Add(Convert.ToDouble(rowData[12]));

      // Touchpad
      controller0TouchpadPressed.Add(Convert.ToBoolean(rowData[13]));
      controller0TouchpadClicked.Add(Convert.ToBoolean(rowData[14]));
      x = Convert.ToDouble(rowData[15]);
      y = Convert.ToDouble(rowData[16]);
      controller0TouchpadValues.Add(new Vector3d(x, y, 0));


      // CONTROLLER 1
      // ORIGIN
      x = Convert.ToDouble(rowData[17]);
      y = Convert.ToDouble(rowData[18]);
      z = Convert.ToDouble(rowData[19]);
      Point3d origin1 = new Point3d(x, y, z);

      // X AXIS
      x = Convert.ToDouble(rowData[20]);
      y = Convert.ToDouble(rowData[21]);
      z = Convert.ToDouble(rowData[22]);
      Vector3d xAxis1 = new Vector3d(x, y, z);

      // Y AXIS
      x = Convert.ToDouble(rowData[23]);
      y = Convert.ToDouble(rowData[24]);
      z = Convert.ToDouble(rowData[25]);
      Vector3d yAxis1 = new Vector3d(x, y, z);

      // CONTROLLER 0 PLANE
      Plane pl1 = new Plane(origin1, xAxis1, yAxis1);
      controller1Planes.Add(pl1);

      // Triggers
      controller1TriggerPressed.Add(Convert.ToBoolean(rowData[26]));
      controller1TriggerClicked.Add(Convert.ToBoolean(rowData[27]));
      controller1TriggerValue.Add(Convert.ToDouble(rowData[28]));

      // Touchpad
      controller1TouchpadPressed.Add(Convert.ToBoolean(rowData[29]));
      controller1TouchpadClicked.Add(Convert.ToBoolean(rowData[30]));
      x = Convert.ToDouble(rowData[31]);
      y = Convert.ToDouble(rowData[32]);
      controller1TouchpadValues.Add(new Vector3d(x, y, 0));

    }

    // Outputs
    Timestamps = timestamps;

    // Controller info
    T0Planes = controller0Planes;
    T0TriggerPressed = controller0TriggerPressed;
    T0TriggerClicked = controller0TriggerClicked;
    T0TriggerValue = controller0TriggerValue;
    T0TouchpadPressed = controller0TouchpadPressed;
    T0TouchpadClicked = controller0TouchpadClicked;
    T0TouchpadValues = controller0TouchpadValues;

    T1Planes = controller1Planes;
    T1TriggerPressed = controller1TriggerPressed;
    T1TriggerClicked = controller1TriggerClicked;
    T1TriggerValue = controller1TriggerValue;
    T1TouchpadPressed = controller1TouchpadPressed;
    T1TouchpadClicked = controller1TouchpadClicked;
    T1TouchpadValues = controller1TouchpadValues;
# ---------- end c_script ----------

pln = Plane(c_script.T1Planes)
bool = Boolean(c_script.T1TriggerPressed)
bool_2 = Boolean(c_script.T1TriggerClicked)
num = Number(c_script.T1TriggerValue)
bool_3 = Boolean(c_script.T1TouchpadPressed)
bool_4 = Boolean(c_script.T1TouchpadClicked)
vec = Vector(c_script.T1TouchpadValues)

num_2 = Number(c_script.T0TriggerValue)
vec_2 = Vector(c_script.T0TouchpadValues)
pln_2 = Plane(c_script.T0Planes)
bool_5 = Boolean(c_script.T0TriggerPressed)
bool_6 = Boolean(c_script.T0TriggerClicked)
bool_7 = Boolean(c_script.T0TouchpadPressed)
bool_8 = Boolean(c_script.T0TouchpadClicked)

num_3 = Number(c_script.Timestamps)

num_4 = Number(python.Timestamps)
pln_3 = Plane(python.T0Planes)
bool_9 = Boolean(python.T0TriggerPressed)
bool_10 = Boolean(python.T0TriggerClicked)
num_5 = Number(python.T0TriggerValues)
bool_11 = Boolean(python.T0TouchpadPressed)
bool_12 = Boolean(python.T0TouchpadClicked)
vec_3 = Vector(python.T0TouchpadValues)

panel_4 = Panel(pln_3)
panel_5 = Panel(bool_9)
panel_6 = Panel(bool_10)
panel_7 = Panel(num_5)
panel_8 = Panel(bool_11)
panel_9 = Panel(bool_12)
panel_10 = Panel(vec_3)

pln_4 = Plane(python.T1Planes)
bool_13 = Boolean(python.T1TriggerPressed)
bool_14 = Boolean(python.T1TriggerClicked)
num_6 = Number(python.T1TriggerValues)
bool_15 = Boolean(python.T1TouchpadPressed)
bool_16 = Boolean(python.T1TouchpadClicked)
vec_4 = Vector(python.T1TouchpadValues)

panel_11 = Panel(pln_4)
panel_12 = Panel(bool_13)
panel_13 = Panel(bool_14)
panel_14 = Panel(num_6)
panel_15 = Panel(bool_15)
panel_16 = Panel(bool_16)
panel_17 = Panel(vec_4)
panel_18 = Panel(num_3)
panel_19 = Panel(num_4)

c_script_2 = CSharpScript(
    plane=pln_2,
    cleanGeometry=Toggle(False),
    generate=bool_7,
    radius=Slider(0.012, range=0..1),
    width1=Slider(0.01, range=0..1),
    width2=Slider(0.03, range=0..1),
    height=Slider(0.5, range=0..1))  # -> out, sphere, cone, box, line; inputs plane: Plane, cleanGeometry: Boolean, generate: Boolean, radius: Double, width1: Double, width2: Double, height: Double
# ---------- c_script_2: C# ----------
    if (cleanGeometry == true && generate == false) {
      return;
    }

    // Sphere generation
    Sphere s = new Sphere(plane, radius);

    // Cone generation
    Cone c = new Cone(plane, height, radius);

    // Box
    Interval ix = new Interval(-0.5 * width1, 0.5 * width1);
    Interval iy = new Interval(-0.5 * width2, 0.5 * width2);
    Interval iz = new Interval(0, height);
    Box b = new Box(plane, ix, iy, iz);

    // Line
    Vector3d translation = plane.ZAxis * height;
    Point3d endPoint = plane.Origin + translation;
    Line l = new Line(plane.Origin, endPoint);


    // Outputs
    sphere = s;
    cone = c;
    box = b;
    line = l;
# ---------- end c_script_2 ----------
geo = Geometry(c_script_2.sphere)
geo_2 = Geometry(c_script_2.cone)
geo_3 = Geometry(c_script_2.box)

c_script_3 = CSharpScript(planes=pln_2, maxHeight=Slider(10, range=0..10))  # -> out, polyline, curve, lines, graphPoly, loft; inputs planes: list of Plane, maxHeight: Double
# ---------- c_script_3: C# ----------
    // Take all origin points
    var origins = new List<Point3d>();
    for (int i = 0; i < planes.Count; i++) {
      origins.Add(planes[i].Origin);
    }

    // Create polyline
    Polyline poly = new Polyline(origins);

    // Create Curve
    Curve c = Curve.CreateInterpolatedCurve(origins, 3);

    // Lines
    var lin = new List<Line>();
    for (int i = 1; i < planes.Count; i++) {
      Plane p = planes[i];
      Plane prevP = planes[i - 1];

      // double factor = Math.Sin(2 * Math.PI * (i / (double) planes.Count));
      double dist = p.Origin.DistanceTo(prevP.Origin);
      double factor = dist;

      Line l = LinePerpendicularToPlane(p, factor * maxHeight);
      lin.Add(l);
    }

    // Polyline with speed of the motion
    var graphPoints = new List<Point3d>();
    foreach (Line line in lin) {
      graphPoints.Add(line.To);
    }
    Polyline graph = new Polyline(graphPoints);
    
    // Loft
    var curvedLines = new List<Curve>();
    foreach(Line l in lin) {
      curvedLines.Add(l.ToNurbsCurve());
    }
    Brep[] srf = Brep.CreateFromLoft(curvedLines, Point3d.Unset, Point3d.Unset, LoftType.Normal, false);

    polyline = poly;
    curve = c;
    lines = lin;
    graphPoly = graph;
    loft = srf;
# ---------- c_script_3: C# additional code ----------
  Line LinePerpendicularToPlane(Plane plane, double height) {
    // Line
    Vector3d translation = plane.ZAxis * height;
    Point3d endPoint = plane.Origin + translation;
    Line l = new Line(plane.Origin, endPoint);
    return l;
  }
# ---------- end c_script_3 ----------
geo_4 = Geometry(c_script_3.polyline)
geo_5 = Geometry(c_script_3.curve)
geo_6 = Geometry(c_script_3.lines)
geo_7 = Geometry(c_script_3.graphPoly)

python_2 = GhPythonScript(
    plane=pln_3,
    cleanGeometry=Toggle(False),
    generate=bool_11,
    radius=Slider(0.012, range=0..1),
    width1=Slider(0.01, range=0..1),
    width2=Slider(0.03, range=0..1),
    height=Slider(0.5, range=0..1))  # -> out, sphere, cone, box, line; inputs plane: Plane, cleanGeometry: Boolean, generate: Boolean
# ---------- python_2: Python ----------
__author__ = "Usuario Dell"
__version__ = "2021.01.18"

import rhinoscriptsyntax as rs
import Rhino as rh

if cleanGeometry == False and generate == False:
    #SPHERE GENERATION
    sphere = rs.AddSphere(plane, radius)
    #CONE GENERATION
    cone = rs.AddCone(plane, height, radius)
    #BOX
    ix = rh.Geometry.Interval(-0.5 * width1, 0.5 * width1)
    iy = rh.Geometry.Interval(-0.5 * width2, 0.5 * width2)
    iz = rh.Geometry.Interval(0, height)
    box = rh.Geometry.Box(plane, ix, iy, iz)
    #LINE
    translation = plane.ZAxis * height
    endPoint = plane.Origin + translation
    line = rh.Geometry.Line(plane.Origin, endPoint)

elif cleanGeometry == True and generate == True:
    #SPHERE GENERATION
    sphere = rs.AddSphere(plane, radius)
    #CONE GENERATION
    cone = rs.AddCone(plane, height, radius)
    #BOX
    ix = rh.Geometry.Interval(-0.5 * width1, 0.5 * width1)
    iy = rh.Geometry.Interval(-0.5 * width2, 0.5 * width2)
    iz = rh.Geometry.Interval(0, height)
    box = rh.Geometry.Box(plane, ix, iy, iz)
    #LINE
    translation = plane.ZAxis * height
    endPoint = plane.Origin + translation
    line = rh.Geometry.Line(plane.Origin, endPoint)

elif cleanGeometry == False and generate == True:
    #SPHERE GENERATION
    sphere = rs.AddSphere(plane, radius)
    #CONE GENERATION
    cone = rs.AddCone(plane, height, radius)
    #BOX
    ix = rh.Geometry.Interval(-0.5 * width1, 0.5 * width1)
    iy = rh.Geometry.Interval(-0.5 * width2, 0.5 * width2)
    iz = rh.Geometry.Interval(0, height)
    box = rh.Geometry.Box(plane, ix, iy, iz)
    #LINE
    translation = plane.ZAxis * height
    endPoint = plane.Origin + translation
    line = rh.Geometry.Line(plane.Origin, endPoint)
# ---------- end python_2 ----------
geo_8 = Geometry(python_2.sphere)
geo_9 = Geometry(python_2.cone)
geo_10 = Geometry(python_2.box)
geo_11 = Geometry(python_2.line)

python_3 = GhPythonScript(planes=pln_3, maxHeight=Slider(10, range=0..10))  # -> out, polyline, curve, lines, graphPoly, loft; inputs planes: list of Plane
# ---------- python_3: Python ----------
__author__ = "Usuario Dell"
__version__ = "2021.01.19"

import rhinoscriptsyntax as rs
import Rhino as rh
import math


def LinePerpendicularToPlane(plane, height):
    #LINE
    translation = plane.ZAxis * height
    endPoint = plane.Origin + translation
    line = rh.Geometry.Line(plane.Origin, endPoint)
    l = line
    return l

#TAKE ALL ORIGIN POINTS
origins = []
for i in range(len(planes)):
    origins.append(planes[i].Origin)

#CREATE POLYLINE
polyline = rs.AddPolyline(origins)

#CREATE CURVE
curve = rh.Geometry.Curve.CreateInterpolatedCurve(origins, 3)

#LINES
lines = []
for i in range(1,len(planes)):
    p = planes[i]
    prevP = planes[i-1]
    
    factor = math.sin(2 * math.pi * (i / planes.Count))
    dist = p.Origin.DistanceTo(prevP.Origin)
    factor = dist
    l = LinePerpendicularToPlane(p, factor * maxHeight)
    lines.append(l)

#POLYLINE WITH SPEED OF THE MOTION
graphPoints = []
for line in lines:
    graphPoints.append(line.To)
graphPoly = rs.AddPolyline(graphPoints)

#LOFT
curvedLines = []
for l in lines:
    curvedLines.append(l.ToNurbsCurve())

#srf = rh.Geometry.Brep.CreateFromLoft(curvedLines, Point3d.Unset, Point3d.Unset, LoftType.Normal, False)

#srf = rh.Geometry.Brep.CreateFromLoft(curvedLines, Unset, Unset, LoftType.Normal, False)
loft = rs.AddLoftSrf(curvedLines)
# ---------- end python_3 ----------
geo_12 = Geometry(python_3.polyline)
geo_13 = Geometry(python_3.curve)
geo_14 = Geometry(python_3.lines)
geo_15 = Geometry(python_3.graphPoly)
geo_16 = Geometry(python_3.loft)

geo_17 = Geometry(c_script_2.line)
geo_18 = Geometry(c_script_3.loft)
