# Grasshopper definition 2.2 Using_python_Component.gh (Grasshopper 1.0.7)

ghpython_script = GhPythonScript(x=Slider(10, range=0..10), y=Slider(10, range=0..10))  # -> out, A, sum, sqrt, mult
# ---------- ghpython_script: Python ----------
import rhinoscriptsyntax as rs
import math


print("Hello message to the console!")
print("First input value was " + str(x))


A = "Hello, World!"

sum = x + y
sqrt = math.sqrt(x)
mult = x * y
# ---------- end ghpython_script ----------
panel = Panel(ghpython_script.A)
panel_2 = Panel(ghpython_script.sum)
panel_3 = Panel(ghpython_script.mult)
panel_4 = Panel(ghpython_script.sqrt)
panel_5 = Panel(ghpython_script.out)
