# Grasshopper definition 3.2 Scripting with Geometry_py.gh (Grasshopper 1.0.7)

number_slider = Slider(2.83, range=0..10)
number_slider_2 = Slider(3.68, range=0..10)
number_slider_3 = Slider(7.56, range=0..10)
number_slider_4 = Slider(6.61, range=0..10)
number_slider_5 = Slider(4.27, range=0..10)
number_slider_6 = Slider(3.41, range=0..10)
number_slider_7 = Slider(2.53, range=0..10)
number_slider_8 = Slider(2.9, range=0..10)
number_slider_9 = Slider(6.77, range=0..10)
number_slider_10 = Slider(2.83, range=0..10)
number_slider_11 = Slider(2.7, range=0..10)
number_slider_12 = Slider(7.56, range=0..10)
number_slider_13 = Slider(6.76, range=0..10)
number_slider_14 = Slider(5.18, range=0..10)
number_slider_15 = Slider(3.9, range=0..10)
number_slider_16 = Slider(4.96, range=0..10)
number_slider_17 = Slider(2.49, range=0..10)
number_slider_18 = Slider(6.28, range=0..10)
construct_point = CSharpScript(x=number_slider, y=number_slider_2, z=number_slider_3)  # -> out, P; inputs x: Double, y: Double, z: Double
# ---------- construct_point: C# ----------
    // Algorithm
    Point3d p = new Point3d(x, y, z);

    // Outputs
    P = p;
# ---------- end construct_point ----------
construct_point_2 = CSharpScript(x=number_slider_4, y=number_slider_5, z=number_slider_6)  # -> out, P; inputs x: Double, y: Double, z: Double; same code as construct_point
construct_vector = CSharpScript(x=number_slider_7, y=number_slider_8, z=number_slider_9)  # -> out, V; inputs x: Double, y: Double, z: Double
# ---------- construct_vector: C# ----------
    // Algorithm
    Vector3d v = new Vector3d(x, y, z);

    // Outputs
    V = v;
# ---------- end construct_vector ----------
construct_point_3 = CSharpScript(x=number_slider_10, y=number_slider_11, z=number_slider_12)  # -> out, P; inputs x: Double, y: Double, z: Double; same code as construct_point
construct_vector_2 = CSharpScript(x=number_slider_13, y=number_slider_14, z=number_slider_15)  # -> out, V; inputs x: Double, y: Double, z: Double; same code as construct_vector
construct_vector_3 = CSharpScript(x=number_slider_16, y=number_slider_17, z=number_slider_18)  # -> out, V; inputs x: Double, y: Double, z: Double; same code as construct_vector
number_slider_19 = Slider(0.64, range=-5..5)
panel = Panel(construct_vector_3.V)
line = CSharpScript(A=construct_point_2.P, B=construct_point.P)  # -> out, L; inputs A: Point3d, B: Point3d
# ---------- line: C# ----------
    // Algorithm
    Line line = new Line(A, B);
    
    // Outputs
    L = line;
# ---------- end line ----------
vector_2pt = CSharpScript(A=construct_point_2.P, B=construct_point.P)  # -> out, V; inputs A: Point3d, B: Point3d
# ---------- vector_2pt: C# ----------
    // Algorithm
    Vector3d v = B - A;  // rc operator oveloads

    // Outputs
    V = v;
# ---------- end vector_2pt ----------
deconstruct_point = CSharpScript(P=construct_point_2.P)  # -> out, X, Y, Z; inputs P: Point3d
# ---------- deconstruct_point: C# ----------
    // Algorithm
    
    // Output
    X = P.X;
    Y = P.Y;
    Z = P.Z;
# ---------- end deconstruct_point ----------
plane = CSharpScript(O=construct_point_3.P, X=construct_vector.V, Y=construct_vector_2.V)  # -> out, Pl; inputs O: Point3d, X: Vector3d, Y: Vector3d
# ---------- plane: C# ----------
    // Algorithm
    Plane pl = new Plane(O, X, Y);
    
    // Outputs
    Pl = pl;
# ---------- end plane ----------
panel_2 = Panel(vector_2pt.V)
vdis = VectorDisplay(Anchor=construct_point_2.P, Vector=vector_2pt.V)
panel_3 = Panel(deconstruct_point.X)
panel_4 = Panel(deconstruct_point.Y)
panel_5 = Panel(deconstruct_point.Z)
panel_6 = Panel(line.L)
panel_7 = Panel(plane.Pl)
pointat_line = CSharpScript(L=line.L, t=number_slider_19)  # -> out, P; inputs L: Line, t: Double
# ---------- pointat_line: C# ----------
    // Algorithm
    Point3d pt = L.PointAt(t);
    
    // Outputs
    P = pt;
# ---------- end pointat_line ----------
ghpython_script = GhPythonScript(x=number_slider_10, y=number_slider_11, z=number_slider_12)  # -> out, P
# ---------- ghpython_script: Python ----------
import rhinoscriptsyntax as rs
import Rhino.Geometry as rg

p = rg.Point3d(x, y, z)

P = p
# ---------- end ghpython_script ----------
ghpython_script_2 = GhPythonScript(x=number_slider_7, y=number_slider_8, z=number_slider_9)  # -> out, V
# ---------- ghpython_script_2: Python ----------
import rhinoscriptsyntax as rs
import Rhino.Geometry as rg

v = rg.Vector3d(x, y, z)

V = v
# ---------- end ghpython_script_2 ----------
ghpython_script_3 = GhPythonScript(x=number_slider_13, y=number_slider_14, z=number_slider_15)  # -> out, V; same code as ghpython_script_2
ghpython_script_4 = GhPythonScript(x=number_slider_16, y=number_slider_17, z=number_slider_18)  # -> out, V; same code as ghpython_script_2
panel_8 = Panel(pointat_line.P)
panel_9 = Panel(ghpython_script_4.V)
ghpython_script_5 = GhPythonScript(O=ghpython_script.P, X=ghpython_script_2.V, Y=ghpython_script_3.V)  # -> out, Pl; inputs O: Point3d, X: Vector3d, Y: Vector3d
# ---------- ghpython_script_5: Python ----------
import rhinoscriptsyntax as rs
import Rhino.Geometry as rg

plane = rg.Plane(O, X, Y)
Pl = plane
# ---------- end ghpython_script_5 ----------
panel_10 = Panel(ghpython_script_5.Pl)
ghpython_script_6 = GhPythonScript(x=number_slider_4, y=number_slider_5, z=number_slider_6)  # -> out, P; same code as ghpython_script
ghpython_script_7 = GhPythonScript(x=number_slider, y=number_slider_2, z=number_slider_3)  # -> out, P; same code as ghpython_script
ghpython_script_8 = GhPythonScript(P=ghpython_script_6.P)  # -> out, X, Y, Z; inputs P: Point3d
# ---------- ghpython_script_8: Python ----------
import rhinoscriptsyntax as rs
import Rhino.Geometry as rg

X = P.X
Y = P.Y
Z = P.Z
# ---------- end ghpython_script_8 ----------
ghpython_script_9 = GhPythonScript(A=ghpython_script_6.P, B=ghpython_script_7.P)  # -> out, L; inputs A: Point3d, B: Point3d
# ---------- ghpython_script_9: Python ----------
import rhinoscriptsyntax as rs
import Rhino.Geometry as rg

L = rg.Line(A, B)
# ---------- end ghpython_script_9 ----------
ghpython_script_10 = GhPythonScript(A=ghpython_script_6.P, B=ghpython_script_7.P)  # -> out, V; inputs A: Point3d, B: Point3d
# ---------- ghpython_script_10: Python ----------
import rhinoscriptsyntax as rs
import Rhino.Geometry as rg


Av = rg.Vector3d(A)
Bv = rg.Vector3d(B)

v = Av - Bv

V = v
# ---------- end ghpython_script_10 ----------
ghpython_script_11 = GhPythonScript(L=ghpython_script_9.L, t=number_slider_19)  # -> out, P; inputs L: Line
# ---------- ghpython_script_11: Python ----------
import rhinoscriptsyntax as rs
import Rhino.Geometry as rg

P = L.PointAt(t)
# ---------- end ghpython_script_11 ----------
panel_11 = Panel(ghpython_script_8.X)
panel_12 = Panel(ghpython_script_8.Y)
panel_13 = Panel(ghpython_script_8.Z)
panel_14 = Panel(ghpython_script_9.L)
vector_display = VectorDisplay(Anchor=ghpython_script_6.P, Vector=ghpython_script_10.V)
panel_15 = Panel(ghpython_script_11.P)
panel_16 = Panel(ghpython_script_10.V)
