# Grasshopper definition 3.3 Advanced Geometry_py.gh (Grasshopper 1.0.7)

crv = Curve(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)
crv_2 = Curve(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)
md_slider = MDSlider(SliderMode=0, slider_value=Point(0, 0, 0.5), x_domain=Domain(0, 1), y_domain=Domain(0, 1), z_domain=Domain(0, 1))
pt = Point(Point(1.687028843, 10.26280391, -1.753171499))
pt_2 = Point(Point(3.249016238, 12.62505604, 0.470307846))
pt_3 = Point(Point(7.127253697, 12.20313404, -0.2982870258))
pt_4 = Point(Point(7.668711709, 7.961568486, 1.407879106))
pt_5 = Point(Point(3.385158437, 7.648926515, 0))
c_script = CSharpScript(A=crv_2, B=crv)  # -> out, BLEND; inputs A: Curve, B: Curve
# ---------- c_script: C# ----------
    // Algorithm
    Curve blend = Curve.CreateBlendCurve(A, B, BlendContinuity.Curvature);

    // Outputs
    BLEND = blend;
# ---------- end c_script ----------
ghpython_script = GhPythonScript(A=crv_2, B=crv)  # -> out, BLEND; inputs A: Curve, B: Curve
# ---------- ghpython_script: Python ----------
import rhinoscriptsyntax as rs
import Rhino.Geometry as rg

blend = rg.Curve.CreateBlendCurve(A, B, rg.BlendContinuity.Curvature)

BLEND = blend
# ---------- end ghpython_script ----------
blendc = BlendCurve(CurveA=crv_2, CurveB=crv, BulgeA=1, BulgeB=1, Continuity=Slider(2, range=0..10))
ghpython_script_2 = GhPythonScript(A=pt_2, B=pt_3, C=pt_4, D=pt_5)  # -> out, S; inputs A: Point3d, B: Point3d, C: Point3d, D: Point3d
# ---------- ghpython_script_2: Python ----------
import rhinoscriptsyntax as rs
import Rhino.Geometry as rg

surf = rg.Brep.CreateFromCornerPoints(A, B, C, D , 0.001)

S = surf
# ---------- end ghpython_script_2 ----------
evaluate_surface = EvaluateSurface(Surface=reparameterize(ghpython_script_2.S), Point=md_slider)  # -> Point, Normal, UDirection, VDirection, Frame
surface_closest_point = SurfaceClosestPoint(Point=pt, Surface=ghpython_script_2.S)  # -> Point, UVPoint, Distance
c_script_2 = CSharpScript(A=pt_2, B=pt_3, C=pt_4, D=pt_5)  # -> out, S; inputs A: Point3d, B: Point3d, C: Point3d, D: Point3d
# ---------- c_script_2: C# ----------
    // Algorithm
    Brep surf = Brep.CreateFromCornerPoints(A, B, C, D, 0.001);

    // Outputs
    S = surf;
# ---------- end c_script_2 ----------
srf4pt = _4PointSurface(CornerA=pt_2, CornerB=pt_3, CornerC=pt_4, CornerD=pt_5)
xy = XYPlane(Origin=evaluate_surface.Point)
xy_2 = XYPlane(Origin=pt)

ghpython_script_3 = GhPythonScript(B=ghpython_script_2.S, P=xy_2)  # -> out, C, Pts; inputs B: Brep, P: Plane
# ---------- ghpython_script_3: Python ----------
import rhinoscriptsyntax as rs
import Rhino.Geometry as rg

sections = []
intersects = []

success = rg.Intersect.Intersection.BrepPlane(B, P, 0.001)

#print(success)
if success[0]:
    print("Intersection worked!")
else:
    print("Intersection failed!")

C = sections
Pts = intersects
# ---------- end ghpython_script_3 ----------
ghpython_script_4 = GhPythonScript(B=ghpython_script_2.S, P=xy)  # -> out, C, Pts; inputs B: Brep, P: Plane
# ---------- ghpython_script_4: Python ----------
import rhinoscriptsyntax as rs
import Rhino.Geometry as rg

sections = []
intersects = []

success = rg.Intersect.Intersection.BrepPlane(B, P, 0.001)

#print(success)
if success[0]:
    print("Intersection worked!")
else:
    print("Intersection failed!")

print(success)
C = success[1]
Pts = success[2]
# ---------- end ghpython_script_4 ----------

c_script_3 = CSharpScript(B=c_script_2.S, P=xy_2)  # -> out, C, Pts; inputs B: Brep, P: Plane
# ---------- c_script_3: C# ----------
    // Algorithm
    Curve[] sections;
    Point3d[] intersects;
    bool success = Rhino.Geometry.Intersect.Intersection.BrepPlane(B, P, 0.001, out sections, out intersects);
    if (success)
    {
      Print("Intersection worked!");
    }
    else
    {
      Print("Intersection failed!");
    }

    // Outputs
    C = sections;
    Pts = intersects;
# ---------- end c_script_3 ----------
sec = BrepPlane(Brep=c_script_2.S, Plane=xy_2)  # -> Curves, Points
panel = Panel(sec.Curves)
panel_2 = Panel(sec.Points)
panel_3 = Panel(c_script_3.out)
panel_4 = Panel(c_script_3.C)
panel_5 = Panel(c_script_3.Pts)
panel_6 = Panel(ghpython_script_3.out)
panel_7 = Panel(ghpython_script_3.C)
panel_8 = Panel(ghpython_script_3.Pts)
panel_9 = Panel(ghpython_script_4.out)
panel_10 = Panel(ghpython_script_4.C)
panel_11 = Panel(ghpython_script_4.Pts)
