# Grasshopper definition 4.1 Classes Vs. Structs_py.gh (Grasshopper 1.0.7)

vec = VectorXYZ(XComponent=Slider(10, range=0..10), YComponent=Slider(0, range=0..10), ZComponent=Slider(0, range=0..10))  # -> Vector, Length
crv = Curve(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)
c_script = CSharpScript(C=crv)  # -> out, C1, C2; inputs C: Curve
# ---------- c_script: C# ----------
    Curve c1 = C;

    C.Domain = new Interval(0, 1);

    Curve c2 = C;

    // Outputs
    C1 = c1;
    C2 = c2;
# ---------- end c_script ----------
ghpython_script = GhPythonScript(C=crv)  # -> out, C1, C2; inputs C: Curve
# ---------- ghpython_script: Python ----------
import rhinoscriptsyntax as rs
import Rhino.Geometry as rg

c1 = C

C.Domain = rg.Interval(0, 1)

c2 = C

C1 = c1
C2 = c2
# ---------- end ghpython_script ----------
domain = Domain(crv)
c_script_2 = CSharpScript(V=vec.Vector)  # -> out, V1, V2; inputs V: Vector3d
# ---------- c_script_2: C# ----------
    Vector3d v1 = V;

    V.Unitize();

    Vector3d v2 = V;

    // Ouptuts
    V1 = v1;
    V2 = v2;
# ---------- end c_script_2 ----------
ghpython_script_2 = GhPythonScript(V=vec.Vector)  # -> out, V1, V2; inputs V: Vector3d
# ---------- ghpython_script_2: Python ----------
import rhinoscriptsyntax as rs
import Rhino.Geometry as rg
import copy

v1 = V

v2 = copy.deepcopy(V)
v2.Unitize()

V1 = v1
V2 = v2
# ---------- end ghpython_script_2 ----------
domain_2 = Domain(ghpython_script.C2)
domain_3 = Domain(c_script.C2)
domain_4 = Domain(ghpython_script.C1)
domain_5 = Domain(c_script.C1)
panel = Panel(ghpython_script_2.V2)
panel_2 = Panel(ghpython_script_2.V1)
panel_3 = Panel(c_script_2.V1)
panel_4 = Panel(c_script_2.V2)
panel_5 = Panel(domain_4)
panel_6 = Panel(domain_2)
panel_7 = Panel(domain)
panel_8 = Panel(domain_5)
panel_9 = Panel(domain_3)
