# Grasshopper definition 4.2 List as Data Inputs_py.gh (Grasshopper 1.0.7)

srf = Surface(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)
# // Algorithm
#     LoftType lt = (LoftType) T;
#     Brep[] lofts = Brep.CreateFromLoft(C, Point3d.Unset,
#       Point3d.Unset, lt, P);
# 
#     // Ouputs
#     L = lofts;
number_slider = Slider(10, range=0..10)
number_slider_2 = Slider(0, range=0..10)
toggle = BooleanToggle(False)
sdivide = DivideSurface(Surface=srf, UCount=Slider(3, range=0..10), VCount=Slider(1, range=0..10))  # -> Points, Normals, Parameters
panel = Panel(sdivide.Points)
series = Series(Start=Slider(4.58, range=0..10), Step=Slider(6.83, range=0..10), Count=number_slider)
panel_2 = Panel(series)
loft_opt = LoftOptions(Closed=toggle, Adjust=False, Rebuild=0, Refit=0, Type=number_slider_2)
crv = Curve([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])
ghpython_script = GhPythonScript(P=sdivide.Points)  # -> out, A; inputs P: tree of Point3d
# ---------- ghpython_script: Python ----------
A = "Hey, I made a calculation"
# ---------- end ghpython_script ----------
c_script = CSharpScript(P=sdivide.Points)  # -> out, A; inputs P: tree of Point3d
# ---------- c_script: C# ----------
    A = "Hey, I made a calculation";
# ---------- end c_script ----------
average = CSharpScript(S=series)  # -> out, Avg; inputs S: list of Double
# ---------- average: C# ----------
    // Algorithm
    double sum = 0;
    for (int i = 0; i < S.Count; i++)
    {
      sum += S[i];
    }
    double average = sum / S.Count;

    // Outputs
    Avg = average;
# ---------- end average ----------
loft = CSharpScript(C=crv, T=number_slider_2, P=toggle)  # -> out, L; inputs C: list of Curve, T: Int32, P: Boolean
# ---------- loft: C# ----------
    // Algorithm
    LoftType lt = (LoftType) T;
    Brep[] lofts = Brep.CreateFromLoft(C, Point3d.Unset,
      Point3d.Unset, lt, P);

    // Ouputs
    L = lofts;
# ---------- end loft ----------
ghpython_script_2 = GhPythonScript(C=crv, T=number_slider_2, P=toggle)  # -> out, L; inputs C: list of Curve, T: Int32, P: Boolean
# ---------- ghpython_script_2: Python ----------
import rhinoscriptsyntax as rs
import Rhino.Geometry as rg

lt = T

lofts = rg.Brep.CreateFromLoft(C, rg.Point3d.Unset, rg.Point3d.Unset, lt, P)

L = lofts
# ---------- end ghpython_script_2 ----------
ghpython_script_3 = GhPythonScript(S=series)  # -> out, Avg; inputs S: list
# ---------- ghpython_script_3: Python ----------
import rhinoscriptsyntax as rs

sum = 0

for i in S:
    sum += i
    #print(sum)

#print(sum)


average = sum / len(S)

Avg = average
# ---------- end ghpython_script_3 ----------
loft_2 = Loft(Curves=crv, Options=loft_opt)
panel_3 = Panel(c_script.A)
# // Algorithm
#     double sum = 0;
#     for (int i = 0; i < S.Count; i++)
#     {
#       sum += S[i];
#     }
#     double average = sum / S.Count;
# 
#     // Outputs
#     Avg = average;
panel_4 = Panel(ghpython_script.A)
panel_5 = Panel(loft_2)
panel_6 = Panel(average.Avg)
panel_7 = Panel(ghpython_script_2.L)
panel_8 = Panel(loft.L)
panel_9 = Panel(ghpython_script_3.Avg)
