# Grasshopper definition 4.3 DataTrees_py.gh (Grasshopper 1.0.7)

number_slider = Slider(5, range=0..10)
number_slider_2 = Slider(1.44, range=0..10)
number_slider_3 = Slider(3, range=0..10)
number_slider_4 = Slider(2.05, range=0..10)
pt = Point(Point(6.263459481, 9.127812048, 0))
srf = Surface(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)
point_grid = CSharpScript(S=pt, NX=number_slider, DX=number_slider_2, NY=number_slider_3, DY=number_slider_4)  # -> out, P; inputs S: Point3d, NX: Int32, DX: Double, NY: Int32, DY: Double
# ---------- point_grid: C# ----------
    // Algorithm
    DataTree<Point3d> pts = new DataTree<Point3d>();

    for (int j = 0; j < NY; j++)
    {
      double y = S.Y + DY * j;
      GH_Path path = new GH_Path(j);

      for (int i = 0; i < NX; i++)
      {
        double x = S.X + DX * i;
        Point3d p = new Point3d(x, y, S.Z);

        pts.Add(p, path);
      }
    }

    // Outputs
    P = pts;
# ---------- end point_grid ----------
sdivide = DivideSurface(Surface=srf, UCount=Slider(2, range=0..10), VCount=Slider(5, range=0..10))  # -> Points, Normals, Parameters
tree_info = CSharpScript(T=point_grid.P)  # -> out, Topology, Description, Paths, BranchCount, ItemCount; inputs T: tree
# ---------- tree_info: C# ----------
    // Algorithm
    List<string> sentences = new List<string>();
    for (int i = 0; i < T.BranchCount; i++)
    {
      List<object> branch = T.Branches[i];
      GH_Path path = T.Paths[i];
      string str = "Branch " + path.ToString() +
        " contains " + branch.Count + " elements";
      sentences.Add(str);
    }
    
    // Outputs
    Topology = T.TopologyDescription;
    Description = sentences;
    Paths = T.Paths;
    BranchCount = T.BranchCount;
    ItemCount = T.DataCount;
# ---------- end tree_info ----------
ghpython_script = GhPythonScript(S=pt, NX=number_slider, DX=number_slider_2, NY=number_slider_3, DY=number_slider_4)  # -> out, P; inputs S: Point3d, NX: Int32, NY: Int32
# ---------- ghpython_script: Python ----------
import rhinoscriptsyntax as rs
import Rhino.Geometry as rg

pts = []

for i in range(0, NX):
    x = S.X + i * DX
    
    for j in range(0, NY):
        
        y = S.Y + j * DY
        
        p = rg.Point3d(x, y, S.Z)
        pts.append(p)

P = pts
# ---------- end ghpython_script ----------
point_grid_no_datatree = CSharpScript(S=pt, NX=number_slider, DX=number_slider_2, NY=number_slider_3, DY=number_slider_4)  # -> out, P; inputs S: Point3d, NX: Int32, DX: Double, NY: Int32, DY: Double
# ---------- point_grid_no_datatree: C# ----------
    // Algorithm
    List<Point3d> pts = new List<Point3d>();
    for (int i = 0; i < NX; i++)
    {
      double x = S.X + i * DX;
      for (int j = 0; j < NY; j++)
      {
        double y = S.Y + j * DY;
        Point3d p = new Point3d(x, y, S.Z);
        pts.Add(p);
      }
    }

    // Outputs
    P = pts;
# ---------- end point_grid_no_datatree ----------
panel = Panel(sdivide.Points)
panel_2 = Panel(point_grid_no_datatree.P)
panel_3 = Panel(ghpython_script.P)
panel_4 = Panel(point_grid.P)
panel_5 = Panel(tree_info.Topology)
panel_6 = Panel(tree_info.BranchCount)
panel_7 = Panel(tree_info.Description)
panel_8 = Panel(tree_info.Paths)
panel_9 = Panel(tree_info.ItemCount)
ghpython_script_2 = GhPythonScript(S=pt, NX=number_slider, DX=number_slider_2, NY=number_slider_3, DY=number_slider_4)  # -> out, P; inputs S: Point3d, NX: Int32, NY: Int32
# ---------- ghpython_script_2: Python ----------
import rhinoscriptsyntax as rs
import Grasshopper.Kernel.Data.GH_Path as ghpath
import Grasshopper.DataTree as datatree
import System
import Rhino.Geometry as rg

pts = datatree[System.Object]()

for j in range(0, NY):
    
    y = S.Y + DY * j
    
    path = ghpath(j)
    for i in range(0, NX):
        x = S.X + DX * i
        p = rg.Point3d(x, y, S.Z)
        
        pts.Add(p, path)



P = pts
# ---------- end ghpython_script_2 ----------
ghpython_script_3 = GhPythonScript(T=ghpython_script_2.P)  # -> out, Topology, Description, Paths, BranchCount, ItemCount; inputs T: tree of Point3d
# ---------- ghpython_script_3: Python ----------
import rhinoscriptsyntax as rs
import Grasshopper.Kernel.Data.GH_Path as ghpath
import Grasshopper.DataTree as datatree
import System
import Rhino.Geometry as rg

pts = datatree[System.Object]()

sentences = []

for i in range(T.BranchCount):
    branch = T.Branches[i]
    path = T.Paths[i]
    str = "Branch "+ path.ToString()+ " contains "+ branch.Count.ToString() + "elements"
    sentences.append(str)

Topology = T.TopologyDescription
Description = sentences
Paths = T.Paths
BranchCount = T.BranchCount
ItemCount = T.DataCount
# ---------- end ghpython_script_3 ----------
panel_10 = Panel(ghpython_script_2.P)
panel_11 = Panel(ghpython_script_3.Description)
panel_12 = Panel(ghpython_script_3.Paths)
panel_13 = Panel(ghpython_script_3.BranchCount)
panel_14 = Panel(ghpython_script_3.ItemCount)
panel_15 = Panel(ghpython_script_3.Topology)
