# Grasshopper definition 4.5 Extending Script Functionality_py.gh (Grasshopper 1.0.7)

number_slider = Slider(10, range=-10..10)
number_slider_2 = Slider(10, range=-10..10)
number_slider_3 = Slider(10, range=-10..10)
number_slider_4 = Slider(100, range=0..100)
c_script = CSharpScript(name="Jose Luis", age=number_slider_4)  # -> out, P; inputs name: String, age: Int32
# ---------- c_script: C# ----------
    Person jl = new Person(name, age);

    P = jl;
# ---------- c_script: C# additional code ----------
  public class Person
  {
    public string Name;
    public int Age;

    public Person(string name, int age)
    {
      this.Name = name;
      this.Age = age;
    }

    public string SayHi()
    {
      return "Hello! My name is " + this.Name +
        " and I am " + this.Age + " years old!";
    }

    public override string ToString()
    {
      return this.Name + ", " + this.Age;
    }
  }
# ---------- end c_script ----------
c_script_2 = CSharpScript(P=c_script.P)  # -> out, name, age
# ---------- c_script_2: C# ----------
    Person person = (Person) P;
    
    name = person.Name;
    age = person.Age;
# ---------- c_script_2: C# additional code ----------
  public class Person
  {
    public string Name;
    public int Age;

    public Person(string name, int age)
    {
      this.Name = name;
      this.Age = age;
    }

    public string SayHi()
    {
      return "Hello! My name is " + this.Name +
        " and I am " + this.Age + " years old!";
    }

    public override string ToString()
    {
      return this.Name + ", " + this.Age;
    }
  }
# ---------- end c_script_2 ----------
c_script_3 = CSharpScript(x=number_slider, y=number_slider_2, z=number_slider_3)  # -> out, V, Length, caffeinated; inputs x: Double, y: Double, z: Double
# ---------- c_script_3: C# ----------
    // Algorithm
    Vector3d vec = new Vector3d(x, y, z);

    // Outputs
    V = vec;
    Length = VectorLength(vec);
    caffeinated = HaveYouHadCoffee;
# ---------- c_script_3: C# additional code ----------
  bool HaveYouHadCoffee = false;


  double VectorLength(Vector3d v)
  {
    double len = Math.Sqrt(v.X * v.X + v.Y * v.Y + v.Z * v.Z);
    return len;
  }
# ---------- end c_script_3 ----------
panel = Panel([c_script_2.name, c_script_2.age])
panel_2 = Panel(c_script.P)
panel_3 = Panel(c_script_3.Length)
panel_4 = Panel(c_script_3.V)
panel_5 = Panel(c_script_3.caffeinated)
ghpython_script = GhPythonScript(x=number_slider, y=number_slider_2, z=number_slider_3)  # -> out, V, Length, caffeinated
# ---------- ghpython_script: Python ----------
import rhinoscriptsyntax as rs
import Rhino.Geometry as rg
import math

vec = rg.Vector3d(x, y, z)

def VectorLength(v):
    len = math.sqrt(v.X * v.X + v.Y * v.Y + v.Z * v.Z)
    return len

HaveYouHadCoffe = False




V = vec
Length = VectorLength(vec)
caffeinated = HaveYouHadCoffe
# ---------- end ghpython_script ----------
panel_6 = Panel(ghpython_script.V)
panel_7 = Panel(ghpython_script.Length)
panel_8 = Panel(ghpython_script.caffeinated)
ghpython_script_2 = GhPythonScript(name="Jose Luis", age=number_slider_4)  # -> out, P, Hi; inputs age: Int32
# ---------- ghpython_script_2: Python ----------
import rhinoscriptsyntax as rs

class Person:
    
    Name = name
    Age = age
    
    def Person(self):
        
        self.Name = name
        self.Age = age
        
        return self.Name + ", " + str(self.Age)
        #return name
    def SayHi(self):
        return "Hello! My name is " + self.Name + " and I am " + str(self.Age) + " years old!"

#x = Person()
#print(x.SayHi())

jl = Person()

P = jl.Person()
Hi = jl.SayHi()
# ---------- end ghpython_script_2 ----------
panel_9 = Panel(ghpython_script_2.Hi)
panel_10 = Panel(ghpython_script_2.P)
