# Grasshopper definition 01_HelloWorld.gh (Grasshopper 1.0.7)

# ---- group: 1.3 Our first Program
python = GhPythonScript()  # -> out, a, A
# ---------- python: Python ----------
__author__ = "Usuario Dell"
__version__ = "2020.11.30"

import rhinoscriptsyntax as rs

#This is our first computer program

#This line will print a message  
a = "Hello World!"
print(a)

#This is a single line comment
#This is another single line comment
"""
This is a 
multiline comment

"""

#Case Sensitivity 
A = "Hello"
print(A)
# ---------- end python ----------

# ---- group: 3.2 Variable Types
python_2 = GhPythonScript()  # -> out, a
# ---------- python_2: Python ----------
__author__ = "Usuario Dell"
__version__ = "2020.11.30"

import rhinoscriptsyntax as rs

items = 10; """ Integer number without decimal part """
itemsType = type(items)
print(itemsType)

pi = 3.14159; """ Number with decimal part(and large precision) """
piType = type(pi)
print(piType)

isProfessor = True; """ true or false """
isProfessorType = type(isProfessor)
print(isProfessorType)

message = "Hello World"; """ Text """
messageType = type(message)
print(messageType)

gray = b"byte 127"; """ int from -128 to 127 """
grayType = type(gray)
print(grayType)

half = 0.5; """ number with decimal part(and little precision) """ 
halfType = type(half)
print(halfType)

atoms = 12238147234273583; """ There is no long in python 3  """
atomsType = type(atoms)
print(atomsType)

a = 'a' """ There is no char in python 3 """
aType = type(a)
print(aType)
# ---------- end python_2 ----------

# ---- group: 3.5 Variables_TypeConversions
python_3 = GhPythonScript()  # -> out, a, isProfessor, num, letter, b, c, numberFromFile, numberAsString
# ---------- python_3: Python ----------
__author__ = "Usuario Dell"
__version__ = "2020.12.01"

import rhinoscriptsyntax as rs

a = 10 
print("a", type(a))

isProfessor = True
print("isProfessor", type(isProfessor))

#Implicit conversions 
num = float(15)
print(num)

letter = "a"
print(letter)

#Casting 
b = int(23.9999)
print(b)

#Explicit conversion 
c = int(bool(1))
print(c)

numberFromFile = float("234.2342")
print(numberFromFile)

numberAsString = str("1231231")
print(numberAsString)
# ---------- end python_3 ----------

# ---- group: 3.3 Variables Declaration & Assigment
python_4 = GhPythonScript()  # -> out, a
# ---------- python_4: Python ----------
__author__ = "Usuario Dell"
__version__ = "2020.12.01"

import rhinoscriptsyntax as rs

#Declaration and Assigment

a = 10
print(a)

a = 50
print(a)
# ---------- end python_4 ----------

# ---- group: 3.4 StateBasedVariables
python_5 = GhPythonScript()  # -> out, c
# ---------- python_5: Python ----------
__author__ = "Usuario Dell"
__version__ = "2020.12.01"

import rhinoscriptsyntax as rs

#Declare two variables

a = 2 
b = 3

c = a + b 
print(c)

b = 10
print(c)

c = a + b
print(c)
# ---------- end python_5 ----------

# ---- group: 3.7 Variables_Naming Conventions
python_6 = GhPythonScript()  # -> out, a
# ---------- python_6: Python ----------
__author__ = "Usuario Dell"
__version__ = "2020.12.01"

import rhinoscriptsyntax as rs
#Variables names are written in "camelCase"

myName = "secg"

#Depending on the variable name and scope
#try to not be to short, too ambiguous or too explicit

t = 25.5;               """ too short"""
temp = 25.5;            """ confusing: "temperature" or "temporal" """
temperature = 25.5;     """ getting better """
roomTemp = 25.5;        """ better: explicit about room """
roomTemperature = 25.5; """ perhaps too long? """

#Funtions and classes are written in "PascalCase"
print("println is written in PascalCase")
print("Just like ParametricCamp! :)")
# ---------- end python_6 ----------

# ----
panel = Panel(python_2.out)
panel_2 = Panel(python.a)
panel_3 = Panel(python.A)
panel_4 = Panel(python_6.out)
panel_5 = Panel(python_4.a)
panel_6 = Panel(python_5.c)
panel_7 = Panel([python_3.a, python_3.isProfessor, python_3.num, python_3.letter, python_3.b, python_3.c, python_3.numberFromFile, python_3.numberAsString])
