# Grasshopper definition 04_Operators.gh (Grasshopper 1.0.7)

# ---- group: 4.2 Arithmetic Operators
python = GhPythonScript()  # -> out, add, sub, mult, divInt, divFloat
# ---------- python: Python ----------
__author__ = "Usuario Dell"
__version__ = "2020.12.01"

import rhinoscriptsyntax as rs

#Declare two integer variables

a = 7 
b = 3

add = a + b
sub = a - b
mult = a * b
divInt = int(a/b)
divFloat = a/b

print(add)
print(sub)
print(mult)
print(divInt)
print(divFloat)
# ---------- end python ----------

# ---- group: 4.3 Modulo Operator
python_2 = GhPythonScript(x=Slider(3, range=0..10), y=Slider(2, range=0..10))  # -> out, mod
# ---------- python_2: Python ----------
__author__ = "Usuario Dell"
__version__ = "2020.12.01"

import rhinoscriptsyntax as rs

mod = x % y
print(mod)
# ---------- end python_2 ----------

# ---- group: 4.4 Increment and Decrement Operators
python_3 = GhPythonScript()  # -> out, a
# ---------- python_3: Python ----------
__author__ = "Usuario Dell"
__version__ = "2020.12.01"

import rhinoscriptsyntax as rs
#Increment and Decrement Operators
#Declare a variable 
a = 7
print(a)

#Increase its value by any value
a = a + 3
print(a)

#Increase by 
a += 4
print(a)

#Decrease by 
a -= 3
print(a)

#multiply by 
a *= 2 
print(a)

#divide by 
a /= 2
print(a)

#increase by one
a += 1
print(int(a))

#decrease by one
a -= 1
print(int(a))
# ---------- end python_3 ----------

# ---- group: 4.5 Operator Precedence
python_4 = GhPythonScript()  # -> out, a
# ---------- python_4: Python ----------
__author__ = "Usuario Dell"
__version__ = "2020.12.01"

import rhinoscriptsyntax as rs
#Operator Precedence 
#Executing a compound calculation

calc = 5 * 3 + 9 / 3
print(calc)

print(5 * 3 + 9 / 3)
print((5 * 3) + (9 / 3))
print(5 * (3 + 9) / 3)
# ---------- end python_4 ----------

# ---- group: 4.6 Operations with strings
python_5 = GhPythonScript()  # -> out, a
# ---------- python_5: Python ----------
__author__ = "Usuario Dell"
__version__ = "2020.12.01"

import rhinoscriptsyntax as rs

#Two string variables 
greet = "Hello" 
name = "Jose Luis"

message = greet + " " + name + "!"
print(message)
# ---------- end python_5 ----------

# ---- group: 4.6b String Interpolation
python_6 = GhPythonScript()  # -> out, a
# ---------- python_6: Python ----------
__author__ = "Usuario Dell"
__version__ = "2020.12.01"

import rhinoscriptsyntax as rs

#String Interpolation 
a = 10
b = 5
add = a + b

print(a,"+",b, "=", add)
print('%s + %s = %s '%(a, b, add))
# ---------- end python_6 ----------

# ---- group: 4.7 Arithmetic Functions
python_7 = GhPythonScript()  # -> out, a
# ---------- python_7: Python ----------
__author__ = "Usuario Dell"
__version__ = "2020.12.01"

import rhinoscriptsyntax as rs

#Aritmetic functions 
import math 

tau = 2 * math.pi 
sqrt = math.sqrt(tau)
pow = math.pow(tau, 3)
abs = math.fabs(tau)
rnd = round(tau)
sine = math.sin(tau)
cosine = math.cos(tau)



print(tau)
print(sqrt)
print(pow)
print(rnd)
print(sine)
print(cosine)
# ---------- end python_7 ----------

# ----
panel = Panel(python_2.mod)
panel_2 = Panel([python.add, python.sub, python.mult, python.divInt, python.divFloat])
panel_3 = Panel(python_6.out)
panel_4 = Panel(python_5.out)
panel_5 = Panel(python_7.out)
panel_6 = Panel(python_4.out)
panel_7 = Panel(python_3.a)
panel_8 = Panel(python_3.out)
