# Grasshopper definition 05_Expressions.gh (Grasshopper 1.0.7)

# ---- group: 5.1 Expressions
python = GhPythonScript()  # -> out, a
# ---------- python: Python ----------
__author__ = "Usuario Dell"
__version__ = "2020.12.01"

import rhinoscriptsyntax as rs

#Expressions
#Two values

a = int(10)
b = int(10)

#We can also save these expressions as boolean variables
isGreater = a>b

#Examples of comparisons
print('%s is greater than %s?'%(a,b), isGreater)
print('%s is greater or equal than %s?'%(a,b), a>=b)
print('%s is smaller than %s?'%(a,b), a<b)
print('%s is smaller or equal than %s?'%(a,b), a<=b)
print('%s is equal to %s?'%(a,b), a==b)
print('%s is not equal to %s?'%(a,b), a!=b)
# ---------- end python ----------

# ---- group: 5.2 Conditional If Statements
python_2 = GhPythonScript(a=Slider(5, range=0..10), b=Slider(5, range=0..10))  # -> out, a
# ---------- python_2: Python ----------
__author__ = "Usuario Dell"
__version__ = "2020.12.01"

import rhinoscriptsyntax as rs

#Two values 

if (a>b):
    print('%s is greater than %s'%(a,b))
elif (a<b):
    print('%s is smaller than %s'%(a,b))
else:
    print('%s is equal to %s'%(a,b))
# ---------- end python_2 ----------

# ---- group: 5.3 Logical Operators b
python_3 = GhPythonScript(value=Slider(-1, range=-10..10), min=Slider(-6, range=-10..10), max=Slider(1, range=-10..10))  # -> out, a
# ---------- python_3: Python ----------
__author__ = "Usuario Dell"
__version__ = "2020.12.01"

import rhinoscriptsyntax as rs

#Some values i want to compare 

if value > max or value < min:
    print('%s is outside the [%s, %s] interval'%(value,min, max))

elif value > min and value < max:
    print('%s is inside the [%s, %s] interval'%(value, min, max))
# ---------- end python_3 ----------

# ---- group: 5.3 Logical Operators a
python_4 = GhPythonScript(a=Toggle(True), b=Toggle(False))  # -> out, a; inputs a: Boolean, b: Boolean
# ---------- python_4: Python ----------
__author__ = "Usuario Dell"
__version__ = "2020.12.01"

import rhinoscriptsyntax as rs



print(a)
print(not(a))
print(a and b)
print(a or b)
# ---------- end python_4 ----------

# ----
panel = Panel(python.out)
panel_2 = Panel(python_2.out)
panel_3 = Panel(python_2.a)
panel_4 = Panel(python_4.out)
panel_5 = Panel(python_4.a)
panel_6 = Panel(python_3.out)
