# Grasshopper definition 06_Iterations.gh (Grasshopper 1.0.7)

# ---- group: 6.1 Iteration While Loops a
python = GhPythonScript()  # -> out, a
# ---------- python: Python ----------
__author__ = "Usuario Dell"
__version__ = "2020.12.01"

import rhinoscriptsyntax as rs
#While loop
#Print first ten digits

i = 0

while (i < 10):
    print(i)
    i += 1
# ---------- end python ----------

# ---- group: 6.1 Iterations While Loops b
python_2 = GhPythonScript(i=Slider(3, range=0..10))  # -> out, a; inputs i: Int32
# ---------- python_2: Python ----------
__author__ = "Usuario Dell"
__version__ = "2020.12.01"

import rhinoscriptsyntax as rs
#While loop
#Print first ten digits


while (i < 10):
    print(i)
    i += 1
# ---------- end python_2 ----------

# ---- group: 6.2 Iterations For Loops
python_3 = GhPythonScript(x=Slider(10, range=0..100))  # -> out, a; inputs x: Int32
# ---------- python_3: Python ----------
__author__ = "Usuario Dell"
__version__ = "2020.12.02"

import rhinoscriptsyntax as rs

#For loops
for i in range (0,x):
    print("Hi my friends")
# ---------- end python_3 ----------

# ---- group: 6.3 Iterations Nested Loop
python_4 = GhPythonScript(x=Slider(3, range=0..100), y=Slider(4, range=0..100))  # -> out, a; inputs x: Int32, y: Int32
# ---------- python_4: Python ----------
__author__ = "Usuario Dell"
__version__ = "2020.12.02"

import rhinoscriptsyntax as rs

#Nested Loops

maxRows = x
maxColumns = y

for j in range (0,maxRows):
    for i in range (0, maxColumns):
        print(i,j)
# ---------- end python_4 ----------

# ---- group: 6.4 Iteration Brak Statements
python_5 = GhPythonScript(x=Slider(500, range=0..1000), y=Slider(50, range=0..100))  # -> out, a; inputs x: Int32, y: Int32
# ---------- python_5: Python ----------
__author__ = "Usuario Dell"
__version__ = "2020.12.02"

import rhinoscriptsyntax as rs

#Iteration Break Statements
threshold = x
firstValue = 0
firstSquare = 0

for i in range(0,y,1):
    if (i * i >= threshold):
        firstValue = i
        firstSquare = i*i
        break

print('The first square number %s is %s'%(threshold,firstSquare))
# ---------- end python_5 ----------

# ---- group: 6.5 VariableScope
python_6 = GhPythonScript(x=Slider(5, range=0..10), y=Slider(10, range=0..10), z=Slider(0, range=0..100))  # -> out, a; inputs x: Int32, y: Int32, z: Int32
# ---------- python_6: Python ----------
__author__ = "Usuario Dell"
__version__ = "2020.12.02"

import rhinoscriptsyntax as rs

a = x
b = y

messagge = ""

if a>b:
    message = "Greater"
else:
    message = "Not Greater"

print(message)

sum = int(z)
for i in range (0,10,1):
    sum +=i
print(sum)
# ---------- end python_6 ----------

# ----
panel = Panel(python_4.out)
panel_2 = Panel(python_5.out)
panel_3 = Panel(python.out)
panel_4 = Panel(python_2.out)
panel_5 = Panel(python_6.out)
panel_6 = Panel(python_3.out)
