# Grasshopper definition 07_Lists.gh (Grasshopper 1.0.7)

# ---- group: 7.2 Lists a
python = GhPythonScript()  # -> out, a
# ---------- python: Python ----------
__author__ = "Usuario Dell"
__version__ = "2020.12.03"

import rhinoscriptsyntax as rs

#Lists a
numbers = []

numbers.append(0)
numbers.append(10)
numbers.append(20)
numbers.append(30)
numbers.append(40)
numbers.append(50)
numbers.append(60)
numbers.append(60)
numbers.append(60)
numbers.append(60)
numbers.append(60)

numbers[0] = 23

for i in range(0,len(numbers)):
    print(numbers[i])

#print(numbers[0])
# ---------- end python ----------

# ---- group: 7.2 Lists b
python_2 = GhPythonScript(x=Slider(25, range=0..100), y=Slider(10, range=0..100))  # -> out, a; inputs x: Int32, y: Int32
# ---------- python_2: Python ----------
__author__ = "Usuario Dell"
__version__ = "2020.12.03"

import rhinoscriptsyntax as rs

#Lists b 
numbers = []
elements = x

#Add elements
for i in range(0,elements):
    numbers.append(y*i)

#Manually override values on a list
#numbers[0] = 23
for i in range(0, len(numbers)):
    numbers[i]*=2

#Print all elements
for i in range(0, len(numbers)):
    print(numbers[i])
# ---------- end python_2 ----------

# ---- group: 7.3 Arrays
python_3 = GhPythonScript(x=Slider(10, range=0..100), y=Slider(5, range=0..100))  # -> out, a; inputs x: Int32, y: Int32
# ---------- python_3: Python ----------
__author__ = "Usuario Dell"
__version__ = "2020.12.03"

import rhinoscriptsyntax as rs

#Arrays of data 
capacity = x
numbers = [capacity]

for i in range(0,capacity):
    numbers = y*i
    print(numbers)
# ---------- end python_3 ----------

# ----
panel = Panel(python.out)
panel_2 = Panel(python_3.out)
panel_3 = Panel(python_2.out)
