# Grasshopper definition 08_Functions.gh (Grasshopper 1.0.7)

panel = Panel("""2
4
6
8
10""")

# ---- group: 8.4 Functions overloads
python = GhPythonScript(a=Slider(5, range=0..100), b=Slider(7, range=0..100), c=Slider(12, range=0..100), nums=panel)  # -> out, a; inputs a: Int32, b: Int32, c: Int32, nums: list of Int32
# ---------- python: Python ----------
__author__ = "Usuario Dell"
__version__ = "2020.12.04"

import rhinoscriptsyntax as rs

#Funtion overloads



def additionA(a,b):
    sum = a + b
    return sum

def additionB(a,b,c):
    sum = a + b + c
    return sum

def additionC(values):
    sum = 0
    for i in range(0, len(values)):
        sum += values[i]
    return sum


sumAB = additionA(a,b)
sumABC = additionB(a,b,c)
sumArray = additionC(nums)

print(sumAB)
print(sumABC)
print(sumArray)
# ---------- end python ----------

# ---- group: 8.2 Functions declaration a
python_2 = GhPythonScript(a=Slider(10, range=0..100), b=Slider(23, range=0..100))  # -> out, a
# ---------- python_2: Python ----------
__author__ = "Usuario Dell"
__version__ = "2020.12.04"

import rhinoscriptsyntax as rs

#Functions declaration a

#Add two numbers
sum = a + b
print(sum)
# ---------- end python_2 ----------

# ---- group: 8.2 Functions declaration b
python_3 = GhPythonScript(a=Slider(10, range=0..100), b=Slider(23, range=0..100))  # -> out, a
# ---------- python_3: Python ----------
__author__ = "Usuario Dell"
__version__ = "2020.12.04"

import rhinoscriptsyntax as rs

#Functions declaration b

#Add two numbers


def addition(valueA, valueB):
    added = valueA + valueB
    return added

c = addition(a,b)
print(c)
# ---------- end python_3 ----------

# ---- group: 8.2 Functions declaration c
python_4 = GhPythonScript(x="Jose Luis")  # -> out, a
# ---------- python_4: Python ----------
__author__ = "Usuario Dell"
__version__ = "2020.12.04"

import rhinoscriptsyntax as rs

#Functions declaration c

#Create greeting message
def Greet(name):
    msg = "Hello " +  name + "!"
    return msg

greetingMsg = Greet(x)
print(greetingMsg)
# ---------- end python_4 ----------

# ---- group: 8.6 Void Functions
python_5 = GhPythonScript(x="Jose Luis", y="Hi there!")  # -> out, a
# ---------- python_5: Python ----------
__author__ = "Usuario Dell"
__version__ = "2020.12.04"

import rhinoscriptsyntax as rs

#VoidFuntions
def Greet(name):
    msg = "Hello " + name + "!"
    print(msg)

def Log(string):
    print(string)

Greet(x)
Log(y)
# ---------- end python_5 ----------

# ---- group: 8.5 Functions Scoping
python_6 = GhPythonScript(r=Slider(1, range=0..10))  # -> out, a
# ---------- python_6: Python ----------
__author__ = "Usuario Dell"
__version__ = "2020.12.04"

import rhinoscriptsyntax as rs

#FuntionScope 

import math

TAU = 2 * math.pi

def CircleLength(radius):
    len = TAU * radius
    return len

circleLen = CircleLength(r)
print(circleLen)
# ---------- end python_6 ----------

# ----
panel_2 = Panel(python.out)
panel_3 = Panel(python_4.out)
panel_4 = Panel(python_2.out)
panel_5 = Panel(python_3.out)
panel_6 = Panel(python_5.out)
panel_7 = Panel(python_6.out)
