# Grasshopper definition 3.5 Advanced Arithmetic_Py.gh (Grasshopper 1.0.7)

# ---- group: INPUT PARAMETERS
# The following example is based
# on Parametric Camp LiveStream #49
# https://www.youtube.com/watch?v=hV0qD_51ggs&list=PLx3k0RGeXZ_ykTX9g04xMkzyxUbl1DXuB&index=25
radius = Slider(1.689, range=0..5)

# ---- group: INPUTS
a = Slider(2, range=-100..100)
b = Slider(4, range=-100..100)
c = Slider(53.9, range=-100..100)

# ---- group: CIRCLE LENGTH
expression = Expression(radius=radius, Expression="2 * π * radius")
panel = Panel(expression)

# ---- group: CIRCLE AREA
expression_2 = Expression(radius=radius, Expression="π * radius²")
panel_2 = Panel(expression_2)

# ---- group: VOLUME AREA
expression_3 = Expression(radius=radius, Expression="4 / 3 * π * Pow(radius, 3)")
panel_3 = Panel(expression_3)

# ---- group: SPHERE AREA
expression_4 = Expression(radius=radius, Expression="4 * π * radius²")
panel_4 = Panel(expression_4)

# ---- group: CIRCLE LENGTH
pi = Pi(Factor="2")
multiplication = Multiplication(A=radius, B=pi)
panel_5 = Panel(multiplication)

# ---- group: QUADRATIC FORMULA
expression_5 = Expression(a=a, b=b, c=c, Expression="(-b - Sqrt(b² - 4 * a * c)) / 2 * a")
expression_6 = Expression(a=a, b=b, c=c, Expression="(-b + Sqrt(b² - 4 * a * c)) / 2 * a")
panel_6 = Panel(expression_5)
panel_7 = Panel(expression_6)

# ---- group: CIRCLE AREA
sqr = Square(Value=radius)
pi_2 = Pi(Factor=1)
multiplication_2 = Multiplication(A=sqr, B=pi_2)
panel_8 = Panel(multiplication_2)

# ----
python = GhPythonScript(radius=radius)  # -> out, R
# ---------- python: Python ----------
__author__ = "Usuario DELL"
__version__ = "2021.05.31"

import rhinoscriptsyntax as rs
import math

R = 2 * math.pi * radius
# ---------- end python ----------
panel_9 = Panel(python.R)

python_2 = GhPythonScript(radius=radius)  # -> out, R
# ---------- python_2: Python ----------
__author__ = "Usuario DELL"
__version__ = "2021.05.31"

import rhinoscriptsyntax as rs
import math

R = math.pi * math.pow(radius,2)
# ---------- end python_2 ----------
panel_10 = Panel(python_2.R)

python_3 = GhPythonScript(radius=radius)  # -> out, R
# ---------- python_3: Python ----------
__author__ = "Usuario DELL"
__version__ = "2021.05.31"

import rhinoscriptsyntax as rs
import math

R = 4 * math.pi * math.pow(radius,2)
# ---------- end python_3 ----------
panel_11 = Panel(python_3.R)

python_4 = GhPythonScript(radius=radius)  # -> out, R
# ---------- python_4: Python ----------
__author__ = "Usuario DELL"
__version__ = "2021.05.31"

import rhinoscriptsyntax as rs
import math

R = 4/3 * math.pi * math.pow(radius,3)
# ---------- end python_4 ----------
panel_12 = Panel(python_4.R)

python_5 = GhPythonScript(a=a, b=b, c=c)  # -> out, R
# ---------- python_5: Python ----------
__author__ = "Usuario DELL"
__version__ = "2021.05.31"

import rhinoscriptsyntax as rs
import cmath



#discriminant

d = (b**2) - (4*a*c)

R = (-b-cmath.sqrt(d))/(2*a)
# ---------- end python_5 ----------
python_6 = GhPythonScript(a=a, b=b, c=c)  # -> out, R
# ---------- python_6: Python ----------
__author__ = "Usuario DELL"
__version__ = "2021.05.31"

import rhinoscriptsyntax as rs
import cmath



#discriminant

d = (b**2) - (4*a*c)

R = (-b+cmath.sqrt(d))/(2*a)
# ---------- end python_6 ----------
panel_13 = Panel(python_5.R)
panel_14 = Panel(python_6.R)
