# Grasshopper definition E.1 Utility_Components_py.gh (Grasshopper 1.0.7)

number_slider = Slider(10, range=-10..10)
number_slider_2 = Slider(10, range=-10..10)

# ---- group: Arithmetic
# UTILITY COMPONENTS
number_slider_3 = Slider(10, range=-10..10)
division = CSharpScript(A=Slider(10, range=-10..10), B=Slider(10, range=-10..10))  # -> out, R; inputs A: Double, B: Double
# ---------- division: C# ----------
    // Algorithm
    double result = A / B;

    // Output
    R = result;
# ---------- end division ----------
subtraction = CSharpScript(A=Slider(10, range=-10..10), B=Slider(10, range=-10..10))  # -> out, R; inputs A: Double, B: Double
# ---------- subtraction: C# ----------
    // Algorithm
    double sub = A - B;

    // Output
    R = sub;
# ---------- end subtraction ----------
multiplication = CSharpScript(A=Slider(10, range=-10..10), B=Slider(10, range=-10..10))  # -> out, R; inputs A: Double, B: Double
# ---------- multiplication: C# ----------
    // Algorithm
    double result = A * B;

    // Output
    R = result;
# ---------- end multiplication ----------
addition = CSharpScript(A=number_slider_3, B=Slider(10, range=-10..10))  # -> out, R; inputs A: Double, B: Double
# ---------- addition: C# ----------
    // Algorithm
    double sum = A + B;
    
    // Output
    R = sum;
# ---------- end addition ----------
panel = Panel(division.R)
panel_2 = Panel(subtraction.R)
panel_3 = Panel(multiplication.R)
panel_4 = Panel(addition.R)
abs = CSharpScript(A=Slider(-8.49, range=-10..10))  # -> out, R; inputs A: Double
# ---------- abs: C# ----------
    // Algorithm
    double result = Math.Abs(A);

    // Output
    R = result;
# ---------- end abs ----------
power = CSharpScript(A=Slider(10, range=-10..10), B=Slider(3, range=-10..10))  # -> out, R; inputs A: Double, B: Double
# ---------- power: C# ----------
    // Algorithm
    double result = Math.Pow(A, B);

    // Output
    R = result;
# ---------- end power ----------
power_2 = CSharpScript(A=Slider(4, range=-10..10))  # -> out, R; inputs A: Double
# ---------- power_2: C# ----------
    // Algorithm
    double result = Math.Sqrt(A);

    // Output
    R = result;
# ---------- end power_2 ----------
panel_5 = Panel(abs.R)
panel_6 = Panel(power.R)
panel_7 = Panel(power_2.R)

# ----
ghpython_script = GhPythonScript(A=number_slider, B=number_slider_2)  # -> out, R
# ---------- ghpython_script: Python ----------
import rhinoscriptsyntax as rs

R = A + B
# ---------- end ghpython_script ----------
ghpython_script_2 = GhPythonScript(A=number_slider, B=number_slider_2)  # -> out, R
# ---------- ghpython_script_2: Python ----------
import rhinoscriptsyntax as rs

R = A - B
# ---------- end ghpython_script_2 ----------
ghpython_script_3 = GhPythonScript(A=number_slider_2, B=number_slider_2)  # -> out, R
# ---------- ghpython_script_3: Python ----------
import rhinoscriptsyntax as rs

R = A * B
# ---------- end ghpython_script_3 ----------
ghpython_script_4 = GhPythonScript(A=number_slider_2, B=number_slider_2)  # -> out, R
# ---------- ghpython_script_4: Python ----------
import rhinoscriptsyntax as rs

R = A/B
# ---------- end ghpython_script_4 ----------
panel_8 = Panel(ghpython_script_3.R)
panel_9 = Panel(ghpython_script.R)
panel_10 = Panel(ghpython_script_2.R)
panel_11 = Panel(ghpython_script_4.R)
ghpython_script_5 = GhPythonScript(A=Slider(10, range=-10..10), B=Slider(10, range=-10..10))  # -> out, R
# ---------- ghpython_script_5: Python ----------
import math

R = math.pow(A, B)
# ---------- end ghpython_script_5 ----------
ghpython_script_6 = GhPythonScript(A=Slider(-8.49, range=-10..10))  # -> out, R
# ---------- ghpython_script_6: Python ----------
import math

R = abs(A)
# ---------- end ghpython_script_6 ----------
ghpython_script_7 = GhPythonScript(A=Slider(4, range=0..10))  # -> out, R
# ---------- ghpython_script_7: Python ----------
import math

R = math.sqrt(A)
# ---------- end ghpython_script_7 ----------
panel_12 = Panel(ghpython_script_6.R)
panel_13 = Panel(ghpython_script_7.R)
number = Number(ghpython_script_5.R)
panel_14 = Panel(ghpython_script_5.R)
format = Format(Format="{0:0.000}", Culture=127, Data0=number)

# ---- group: String Manipulations
string_length = CSharpScript(S="Hello World!")  # -> out, Chars; inputs S: String
# ---------- string_length: C# ----------
    // Algorithm
    List<char> characters = new List<char>();
    
    for (int i = 0; i < S.Length; i++)
    {
      characters.Add(S[i]);
    }
    
    // Outputs
    Chars = characters;
# ---------- end string_length ----------
string_concat = CSharpScript(A="Hello ", B="World!")  # -> out, R; inputs A: String, B: String
# ---------- string_concat: C# ----------
    // Algorithm
    string result = A + B;

    // Output
    R = result;
# ---------- end string_concat ----------
string_length_2 = CSharpScript(S="Hello World!")  # -> out, L; inputs S: String
# ---------- string_length_2: C# ----------
    // Algorithm
    int res = S.Length;
    
    // Outputs
    L = res;
# ---------- end string_length_2 ----------
panel_15 = Panel(string_concat.R)
panel_16 = Panel(string_length_2.L)
panel_17 = Panel(string_length.Chars)

# ----
panel_18 = Panel(format)
ghpython_script_8 = GhPythonScript(S="Hello World!")  # -> out, char
# ---------- ghpython_script_8: Python ----------
import math

characters = []

for i in S:
    characters.append(i)

char = characters
# ---------- end ghpython_script_8 ----------
ghpython_script_9 = GhPythonScript(A="Hello", B=" World!")  # -> out, R
# ---------- ghpython_script_9: Python ----------
import math

R = A + B
# ---------- end ghpython_script_9 ----------
ghpython_script_10 = GhPythonScript(S="Hello World!")  # -> out, L
# ---------- ghpython_script_10: Python ----------
import math

L = len(S)
# ---------- end ghpython_script_10 ----------
panel_19 = Panel(ghpython_script_9.R)
panel_20 = Panel(ghpython_script_10.L)
panel_21 = Panel(ghpython_script_8.char)

# ---- group: Numerical Sequences
number_slider_4 = Slider(9, range=0..10)
number_slider_5 = Slider(7, range=0..10)
number_slider_6 = Slider(0, range=-10..10)
number_slider_7 = Slider(1.5, range=-10..10)
dom = ConstructDomain(DomainStart=Slider(0, range=-10..10), DomainEnd=Slider(10, range=-10..10))
series = CSharpScript(S=number_slider_6, N=number_slider_7, C=number_slider_5)  # -> out, Sout; inputs S: Double, N: Double, C: Int32
# ---------- series: C# ----------
    // Algorithm
    List<double> vals = new List<double>();

    for (int i = 0; i < C; i++)
    {
      double v = S + i * N;
      vals.Add(v);
    }

    // Outputs
    Sout = vals;
# ---------- end series ----------
range = CSharpScript(D=dom, N=number_slider_4)  # -> out, R; inputs N: Int32
# ---------- range: C# ----------
    // Algorithm
    double step = (D.T1 - D.T0) / N;

    List<double> vals = new List<double>();

    for (int i = 0; i < N + 1; i++)
    {
      double v = D.T0 + i * step;
      vals.Add(v);
    }

    // Outputs
    R = vals;
# ---------- end range ----------
panel_22 = Panel(series.Sout)
panel_23 = Panel(range.R)

# ----
ghpython_script_11 = GhPythonScript(S=number_slider_6, N=number_slider_7, C=number_slider_5)  # -> out, Sout; inputs C: Int32
# ---------- ghpython_script_11: Python ----------
import math

vals = []

for i in range(C):
    v = S + i * N
    vals.append(v)

Sout = vals
# ---------- end ghpython_script_11 ----------
ghpython_script_12 = GhPythonScript(D=dom, N=number_slider_4)  # -> out, R; inputs N: Int32
# ---------- ghpython_script_12: Python ----------
import math

step = (D.T1 - D.T0) / N 

vals = []



for i in range(N):
    v = D.T0 + i * step
    vals.append(v)

R = vals
# ---------- end ghpython_script_12 ----------
panel_24 = Panel(ghpython_script_11.Sout)
panel_25 = Panel(ghpython_script_12.R)
