# Grasshopper definition E03_NumericalSeries.gh (Grasshopper 1.0.7)

number_slider = Slider(8, range=0..100)

# ---- group: ForLoop_OddNumbers
python = GhPythonScript(x=Slider(10, range=0..10), y="2", z="0")  # -> out, a; inputs x: Int32, y: Int32, z: Int32
# ---------- python: Python ----------
__author__ = "Usuario Dell"
__version__ = "2020.12.03"

import rhinoscriptsyntax as rs

print("First ten odd numbers:")
for i in range(z,x):
    print(y*i+1)
# ---------- end python ----------

# ---- group: ForLoop_NegativeNumbers
python_2 = GhPythonScript(x=Slider(-18, range=-50..0), y="-1")  # -> out, a; inputs x: Int32, y: Int32
# ---------- python_2: Python ----------
__author__ = "Usuario Dell"
__version__ = "2020.12.03"

import rhinoscriptsyntax as rs

print("x negative numbers:")
for i in range (0,x,y):
    print(i)
# ---------- end python_2 ----------

# ---- group: ForLoop_OddNumbers
python_3 = GhPythonScript(x=Slider(20, range=0..100), y="2", z="1")  # -> out, a; inputs x: Int32, y: Int32, z: Int32
# ---------- python_3: Python ----------
__author__ = "Usuario Dell"
__version__ = "2020.12.03"

import rhinoscriptsyntax as rs

print("Odd numbers:")
for i in range(z,x,y):
    print(i)
# ---------- end python_3 ----------

# ---- group: ForLoop_SquareNumbers
python_4 = GhPythonScript(x="0", y=Slider(15, range=0..100))  # -> out, a; inputs x: Int32, y: Int32
# ---------- python_4: Python ----------
__author__ = "Usuario Dell"
__version__ = "2020.12.03"

import rhinoscriptsyntax as rs

print("Square numbers:")
for i in range(x,y):
    print(i*i)
# ---------- end python_4 ----------

# ---- group: ForLoop_EvenNumbers
python_5 = GhPythonScript(x=number_slider, y="2")  # -> out, a; inputs x: Int32, y: Int32
# ---------- python_5: Python ----------
__author__ = "Usuario Dell"
__version__ = "2020.12.03"

import rhinoscriptsyntax as rs

print("Even numbers:")
for i in range(0,x,y):
    print(i)
# ---------- end python_5 ----------

python_6 = GhPythonScript(x=number_slider, y="2")  # -> out, a; inputs x: Int32, y: Int32
# ---------- python_6: Python ----------
__author__ = "Usuario Dell"
__version__ = "2020.12.03"

import rhinoscriptsyntax as rs

print("First ten even numbers:")
for i in range(0,x):
    print(y*i)
# ---------- end python_6 ----------

# ---- group: ForLoop_Found
python_7 = GhPythonScript(x=Slider(100, range=0..100))  # -> out, a; inputs x: Int32
# ---------- python_7: Python ----------
__author__ = "Usuario Dell"
__version__ = "2020.12.03"

import rhinoscriptsyntax as rs

found = 0
for i in range(0,x):
    if i % 2 == 1:
        print(i)
        found += 1
        if found >= 10:
            break
# ---------- end python_7 ----------

# ---- group: ForLoop_Numbers
python_8 = GhPythonScript(x=Slider(10, range=0..100))  # -> out, a; inputs x: Int32
# ---------- python_8: Python ----------
__author__ = "Usuario Dell"
__version__ = "2020.12.03"

import rhinoscriptsyntax as rs

#Examples of numerical series
print("First x numbers:")
for i in range (0,x):
    print(i)
# ---------- end python_8 ----------

# ---- group: ForLoop_MultValue
python_9 = GhPythonScript(x=Slider(12473, range=0..100000))  # -> out, a; inputs x: Int32
# ---------- python_9: Python ----------
__author__ = "Usuario Dell"
__version__ = "2020.12.03"

import rhinoscriptsyntax as rs

multValue = x
print('The multiplication table for number %s'%(multValue))
for i in range(0,10):
    print('multValue x i = %s '%(multValue * i))
# ---------- end python_9 ----------

# ---- group: ForLoop_Alphabet
python_10 = GhPythonScript(x="26", y="65", z="97")  # -> out, a; inputs x: Int32, y: Int32, z: Int32
# ---------- python_10: Python ----------
__author__ = "Usuario Dell"
__version__ = "2020.12.03"

import rhinoscriptsyntax as rs
alphabet = ""
alphabetLowCase = ""
for i in range(0,x):
    alphabet += chr(y+i)
    alphabetLowCase += chr(z+i)
    print(i,':{}'.format(alphabet))
# ---------- end python_10 ----------

# ---- group: ForLoop_PrimeNumbers
python_11 = GhPythonScript(x=Slider(100, range=0..1000))  # -> out, a; inputs x: Int32
# ---------- python_11: Python ----------
__author__ = "Usuario Dell"
__version__ = "2020.12.03"

import rhinoscriptsyntax as rs

print("Prime numbers")
for i in range(2,x):
    isPrime = True
    for j in range(2,i):
        if i % j == 0:
            isPrime = False
            break
    if isPrime == True:
        print(i)
# ---------- end python_11 ----------

# ---- group: ForLoop_FibonacciSequence
python_12 = GhPythonScript(x=Slider(15, range=0..100))  # -> out, a; inputs x: Int32
# ---------- python_12: Python ----------
__author__ = "Usuario Dell"
__version__ = "2020.12.03"

import rhinoscriptsyntax as rs

print("Fibonacci sequence")
prev1 = 1
prev2 = 1
print(prev1)
print(prev2)

for i in range(0,x):
    sum = prev1 + prev2
    print(sum)
    
    prev1 = prev2
    prev2 = sum
# ---------- end python_12 ----------

# ---- group: ForLoop_MassAddition
python_13 = GhPythonScript(x=Slider(18, range=0..100))  # -> out, a; inputs x: Int32
# ---------- python_13: Python ----------
__author__ = "Usuario Dell"
__version__ = "2020.12.03"

import rhinoscriptsyntax as rs

print("The addition of the first ten numbers")
massAddition = 0;

for i in range(0,x):
    massAddition += i
print(massAddition)
# ---------- end python_13 ----------

# ----
panel = Panel(python_10.out)
panel_2 = Panel(python_9.out)
panel_3 = Panel(python_8.out)
panel_4 = Panel(python_2.out)
panel_5 = Panel(python_4.out)
panel_6 = Panel(python_5.out)
panel_7 = Panel(python_6.out)
panel_8 = Panel(python_3.out)
panel_9 = Panel(python.out)
panel_10 = Panel(python_7.out)
panel_11 = Panel(python_13.out)
panel_12 = Panel(python_12.out)
panel_13 = Panel(python_11.out)
