# Grasshopper definition LiveStream38.gh (Grasshopper 1.0.7)
# plug-ins: HoopSnake

button = Button()
crv = Curve(<curve referenced from the Rhino model>)
crv_2 = Curve(crv)
c_script = CSharpScript(Poly=crv_2, Levels=Slider(3, range=0..10))  # -> Out, Sierpinski
geo = Geometry(c_script.Sierpinski)
boundary = BoundarySurfaces(Edges=geo)

panel = Panel(crv)

number_slider = Slider(0.5, range=0..1)  # disabled
panel_2 = Panel("-1")  # disabled

hs = HoopSnake(
    StartingData=crv,
    Data=graft(crv_3),
    TerminationCondition=Slider(3, range=0..10),
    Hoopsnake_Data_autoUpdate=False,
    Hoopsnake_Data_dataLimit=2147483647,
    Hoopsnake_Data_delay=0,
    Hoopsnake_Data_resetCounter=True,
    Hoopsnake_Data_updateView=True)  # -> Feedback, CumulativeFeedback, LoopsCounter, IterationsCounter

explode = Explode(Curve=hs.Feedback, Recursive=True)  # -> Segments, Vertices
domain = Domain(explode.Segments)
end = EndPoints(Curve=explode.Segments)  # -> Start, End
eval = EvaluateCurve(Curve=reparameterize(explode.Segments), Parameter=Slider(0.5, range=0..1))  # -> Point, Tangent, Angle
shift = ShiftList(List=eval.Point, Shift="-1", Wrap=True)
panel_3 = Panel(eval.Point)
panel_4 = Panel(domain)
graft = GraftTree(Tree=eval.Point, IncludeEmptyLists=True, IncludeNullItems=True)  # -> simplify(Tree)
graft_2 = GraftTree(Tree=end.Start, IncludeEmptyLists=True, IncludeNullItems=True)  # -> simplify(Tree)
panel_5 = Panel(shift)
graft_3 = GraftTree(Tree=shift, IncludeEmptyLists=True, IncludeNullItems=True)  # -> simplify(Tree)
panel_6 = Panel(graft_2)
merge = Merge(Data1=graft_2, Data2=graft, Data3=graft_3, Data4=graft_2)
panel_7 = Panel(graft)
panel_8 = Panel(merge)
pline = PolyLine(Vertices=merge, Closed=False)
crv_3 = Curve(pline)
panel_9 = Panel(graft_3)
boundary_2 = BoundarySurfaces(Edges=crv_3)

explode_2 = Explode(Curve=crv_3, Recursive=True)  # -> Segments, Vertices; disabled
domain_2 = Domain(explode_2.Segments)  # disabled
end_2 = EndPoints(Curve=explode_2.Segments)  # -> Start, End; disabled
eval_2 = EvaluateCurve(Curve=reparameterize(explode_2.Segments), Parameter=number_slider)  # -> Point, Tangent, Angle; disabled
shift_2 = ShiftList(List=eval_2.Point, Shift=panel_2, Wrap=True)  # disabled
panel_10 = Panel(eval_2.Point)  # disabled
panel_11 = Panel(domain_2)  # disabled
graft_4 = GraftTree(Tree=eval_2.Point, IncludeEmptyLists=True, IncludeNullItems=True)  # -> simplify(Tree); disabled
graft_5 = GraftTree(Tree=end_2.Start, IncludeEmptyLists=True, IncludeNullItems=True)  # -> simplify(Tree); disabled
panel_12 = Panel(shift_2)  # disabled
graft_6 = GraftTree(Tree=shift_2, IncludeEmptyLists=True, IncludeNullItems=True)  # -> simplify(Tree); disabled
merge_2 = Merge(Data1=graft_5, Data2=graft_4, Data3=graft_6, Data4=graft_5)  # disabled
panel_13 = Panel(merge_2)  # disabled
pline_2 = PolyLine(Vertices=merge_2, Closed=False)  # disabled
crv_4 = Curve(pline_2)  # disabled
boundary_3 = BoundarySurfaces(Edges=crv_4)  # disabled

explode_3 = Explode(Curve=crv_4, Recursive=True)  # -> Segments, Vertices
domain_3 = Domain(explode_3.Segments)
end_3 = EndPoints(Curve=explode_3.Segments)  # -> Start, End
eval_3 = EvaluateCurve(Curve=reparameterize(explode_3.Segments), Parameter=Slider(0.5, range=0..1))  # -> Point, Tangent, Angle
shift_3 = ShiftList(List=eval_3.Point, Shift="-1", Wrap=True)
panel_14 = Panel(eval_3.Point)
panel_15 = Panel(domain_3)
graft_7 = GraftTree(Tree=eval_3.Point, IncludeEmptyLists=True, IncludeNullItems=True)  # -> simplify(Tree)
graft_8 = GraftTree(Tree=end_3.Start, IncludeEmptyLists=True, IncludeNullItems=True)  # -> simplify(Tree)
panel_16 = Panel(shift_3)
graft_9 = GraftTree(Tree=shift_3, IncludeEmptyLists=True, IncludeNullItems=True)  # -> simplify(Tree)
merge_3 = Merge(Data1=graft_8, Data2=graft_7, Data3=graft_9, Data4=graft_8)
panel_17 = Panel(merge_3)
pline_3 = PolyLine(Vertices=merge_3, Closed=False)
crv_5 = Curve(pline_3)
boundary_4 = BoundarySurfaces(Edges=crv_5)

explode_4 = Explode(Curve=crv_5, Recursive=True)  # -> Segments, Vertices
domain_4 = Domain(explode_4.Segments)
end_4 = EndPoints(Curve=explode_4.Segments)  # -> Start, End
eval_4 = EvaluateCurve(Curve=reparameterize(explode_4.Segments), Parameter=Slider(0.5, range=0..1))  # -> Point, Tangent, Angle
shift_4 = ShiftList(List=eval_4.Point, Shift="-1", Wrap=True)
panel_18 = Panel(eval_4.Point)
panel_19 = Panel(domain_4)
graft_10 = GraftTree(Tree=eval_4.Point, IncludeEmptyLists=True, IncludeNullItems=True)  # -> simplify(Tree)
graft_11 = GraftTree(Tree=end_4.Start, IncludeEmptyLists=True, IncludeNullItems=True)  # -> simplify(Tree)
panel_20 = Panel(shift_4)
graft_12 = GraftTree(Tree=shift_4, IncludeEmptyLists=True, IncludeNullItems=True)  # -> simplify(Tree)
merge_4 = Merge(Data1=graft_11, Data2=graft_10, Data3=graft_12, Data4=graft_11)
panel_21 = Panel(merge_4)
pline_4 = PolyLine(Vertices=merge_4, Closed=False)
crv_6 = Curve(pline_4)
boundary_5 = BoundarySurfaces(Edges=crv_6)
