# Grasshopper definition Geometry Gem #3- Ramer-Douglas-Peucker Polyline Simplification_py.gh (Grasshopper 1.0.7)

number_slider = Slider(0, range=0..100)
pt = Point([Point(-18.23494422, 86.25733798, 0), Point(-1.337448474, 74.93920404, 0), Point(19.54530571, 42.89772625, 0), Point(30.86343965, 72.38863864, 0), Point(54.13734889, 65.21517346, 0), Point(73.4259997, 63.14283908, 0), Point(88.72939208, 73.34510066, 0), Point(101.6416294, 95.3437272, 0)])

# ----
# Geometry Gems
# 03
# Ramer–Douglas–Peucker algorithm
# Part 2
# By Jose Luis García del Castillo y López
# Cleaned by: Hariprasath Loganathan
# Drawn by: VictorLin
number_slider_2 = Slider(3.61, range=0..10)
pline = PolyLine(Vertices=pt, Closed=False)
points = PointList(Points=pt, Size=number_slider_2)

simplify = SimplifyCurve(Curve=pline, Tolerance=number_slider)  # -> Curve, Simplified
c_script = CSharpScript(pts=pt, epsilon=number_slider)  # -> out, result; inputs pts: list of Point3d, epsilon: Double
# ---------- c_script: C# ----------
    // Call simplifyPolyline function and output the result
    result = simplifyPolyline(pts, epsilon);
# ---------- c_script: C# additional code ----------
  List<Point3d> simplifyPolyline(List<Point3d> points, double epsilon) {
    // Create two variables - maxDist and maxIndex and assign the value -1.0 & -1
    double maxDist = -1.0;
    int maxIndex = -1;
    // Loop thru all the points except first and last point
    for (int i = 1; i < points.Count - 1; i++) {
      // Calculate distance from point at i index to line connecting first and last point
      double d = distToLine(points[i], points[0], points[points.Count - 1]);
      // Check if the calculated value is greater than maxDist
      if (d > maxDist) {
        // If TRUE assign the value of d & i to maxDist & maxIndex
        maxDist = d;
        maxIndex = i;
      }
    }
    // Print maxIndex & maxDist
    Print("max index: " + maxIndex + " maxdist: " + maxDist);
    // Create a  variable List of points - cleanPoints
    List<Point3d> cleanPoints;
    // Check if maxDist is greater than epsilon
    if (maxDist > epsilon)
    {
      // Subdivide polylines in two parts
      // Initialise a list of points - leftPoly
      // and assign range of points from 0 index to maxIndex +1
      List<Point3d> leftPoly = points.GetRange(0, maxIndex + 1);
      // Initialise a list of points - rightPoly
      // and assign range of points from maxIndex to points.Count - maxIndex
      List<Point3d> rightPoly = points.GetRange(maxIndex, points.Count - maxIndex);

      // Apply recursion to both leftPoly & rightPoly
      // Assign the resultant lis of points to leftSimplified & rightSimplified respectively
      List<Point3d> leftSimplified = simplifyPolyline(leftPoly, epsilon);
      List<Point3d> rightSimplified = simplifyPolyline(rightPoly, epsilon);

      // Avoid duplicating split points
      rightSimplified.RemoveAt(0);
      // Merge leftSimplified & rightSimplified and assign it to cleanPoints
      cleanPoints = leftSimplified;
      cleanPoints.AddRange(rightSimplified);
    }
    else
    {
      // If FALSE remove all the points between start & end points
      // and initialise cleanPoints with start and end points
      cleanPoints = new List<Point3d>() {points[0], points[points.Count - 1]};
    }
    // Return cleanPoints
    return cleanPoints;
  }

  // Compute distance of point P to line AB using Method II - Cross product
  double distToLine(Point3d P, Point3d A, Point3d B) {
    // Create a vector from two points A & B and assign it to AB vector
    Vector3d AB = B - A;
    // Create a vector from two points A & P and assign it to AP vector
    Vector3d AP = P - A;
    // Refer method II diagrams in GH for formulation
    // Calculate cross product by calling crossProduct function and assign it to cross
    Vector3d cross = crossProduct(AB, AP);
    // Get the length of cross vector from vector property and assign it to lengthCross
    double lengthCross = cross.Length;
    // Get the length of AB vector from vector property and assign it to lengthAB
    double lengthAB = AB.Length;
    // Use the formula derived in method II to get the distance to line
    // h = | AB * AP | / |AB|
    double h = lengthCross / lengthAB;
    // return the value of h
    return h;
  }

  // Compute cross product of two vectors
  Vector3d crossProduct(Vector3d u, Vector3d v) {
    // Calculate the cross product of two vectors and assign each components to x, y & z respectively
    double x = u.Y * v.Z - u.Z * v.Y;
    double y = u.Z * v.X - u.X * v.Z;
    double z = u.X * v.Y - u.Y * v.X;
    // Create a new vector with x, y & z components and return it
    return new Vector3d(x, y, z);
  }
# ---------- end c_script ----------
crv = Curve(simplify.Curve)
pline_2 = PolyLine(Vertices=c_script.result, Closed=False)
panel = Panel(c_script.out)
panel_2 = Panel(c_script.result)

python = GhPythonScript(pts=pt, epsilon=number_slider)  # -> out, result; inputs pts: list of Point3d
# ---------- python: Python ----------
__author__ = "byroncalgua"

import rhinoscriptsyntax as rs
import math 



def simplifyPolyline(points, epsilon):
    maxDist = -1.0
    maxIndex = 1
    
    for i in range(1, len(points)-1):
        d=distToline(points[i], points[0], points[len(points)-1])
        #print(d)
        
        if d > maxDist:
            maxDist = d
            maxIndex = i
    
    print('max index: ' + str(maxIndex), 'max dist: ' + str(maxDist))
    
    cleanPoints = []
    if maxDist > epsilon:
        #print("should do subdivision here")
        
        leftPoly = points[0:maxIndex+1]
        
        #print(len(leftPoly))
        rightPoly = points[maxIndex:] 
        
        #print(leftPoly)
        #print(rightPoly)
        
        #Apply recursion
        leftSimplified = simplifyPolyline(leftPoly, epsilon)
        rightSimplified = simplifyPolyline(rightPoly, epsilon)
        
        rightSimplified = rightSimplified[1:]
        
        
        
        cleanPoints = sum((leftSimplified, rightSimplified), ())
    
    else:
        #remove all points between endpoints and return 
        cleanPoints = points[0], points[len(points)-1]
        
    
    return cleanPoints



def distToline(P, A, B):
    AB = B-A 
    AP = P-A
    cross = crossProduct(AB, AP)
    lengthCross = cross.Length
    lengthAB = AB.Length
    h = lengthCross / lengthAB
    return h

def crossProduct(u, v):
    x = u.Y * v.Z - u.Z * v.Y
    y = u.Z * v.Y - u.X * v.Z
    z = u.X * v.Y - u.Y * v.X
    return rs.CreateVector(x,y,z)


result = simplifyPolyline(pts, epsilon)
# ---------- end python ----------
pline_3 = PolyLine(Vertices=python.result, Closed=False)
panel_3 = Panel(python.out)
# 3
panel_4 = Panel(python.result)
