# Grasshopper definition Geometry Gems #10 Clean Duplicate Lines_py.gh (Grasshopper 1.0.7)

# ----
# GEOMETRY GEM SERIES
# 10
# Remove Duplicate Lines
# Part 1/1
# By Jose Luis García del Castillo y López @ ParametricCamp
# https://youtu.be/NLp4st0bGUA
sqgrid = Square(Plane=PlaneXY(0, 0, 0), Size=1, ExtentX=5, ExtentY=5)  # -> Cells, Points
explode = Explode(Curve=sqgrid.Cells, Recursive=True)  # -> Segments, Vertices
flatten = FlattenTree(Tree=explode.Segments, Path="{0}")
panel = Panel(flatten)

number_slider = Slider(0.006, range=0..1)
c_script = CSharpScript(lines=flatten, tolerance=number_slider)  # -> out, cleanLines; inputs lines: list of Line, tolerance: Double
# ---------- c_script: C# ----------
    cleanLines = RemoveDuplicates(lines, tolerance);
# ---------- c_script: C# additional code ----------
  List<Line> RemoveDuplicates(List<Line> lines, double tolerance) {
    // Copy original list
    List<Line> clean = new List<Line>(lines);

    //Print("cleanCount : " + clean.Count);

    // Clean up the list of duplicates
    for (int i = 0; i < clean.Count; i++) {

      Print("i : " + i);
      Line line = clean[i];

      for (int j = clean.Count - 1; j > i; j--) {
        Line other = clean[j];
        //Print("other : " + other);

        bool dup = AreDuplicate(line, other, tolerance);
        if (dup == true) {
          clean.RemoveAt(j);
        }
      }
    }

    return clean;
  }

  // Returns true if end points of lines are similar under tolerance value
  bool AreDuplicate(Line lineA, Line lineB, double tolerance) {
    // Compare starting points
    if (
      (AreSimilar(lineA.From, lineB.From, tolerance) && AreSimilar(lineA.To, lineB.To, tolerance) )
      || (AreSimilar(lineA.From, lineB.To, tolerance) && AreSimilar(lineA.To, lineB.From, tolerance) )
    ) {
      return true;
    }

    return false;
  }

  // Returns truu if coordinates of points are similar under a threshold value
  bool AreSimilar(Point3d a, Point3d b, double tol) {
    bool similar = Math.Abs(a.X - b.X) < tol
      && Math.Abs(a.Y - b.Y) < tol
      && Math.Abs(a.Z - b.Z) < tol;

    return similar;
  }
# ---------- end c_script ----------
geo = Geometry(c_script.cleanLines)
panel_2 = Panel(c_script.out)
panel_3 = Panel(geo)

# ---- group: Compare two single lines
crv = Curve(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)
crv_2 = Curve(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)
crv_3 = Curve(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)
c_script_2 = CSharpScript(lineA=crv_2, lineB=crv_3, tolerance=number_slider)  # -> out, duplicate; inputs lineA: Line, lineB: Line, tolerance: Double
# ---------- c_script_2: C# ----------
    // Output
    duplicate = AreDuplicate(lineA, lineB, tolerance);
# ---------- c_script_2: C# additional code ----------
  // Returns true if end points of lines are similar under tolerance value
  bool AreDuplicate(Line lineA, Line lineB, double tolerance) {
    // Compare starting points
    if (
      (AreSimilar(lineA.From, lineB.From, tolerance) && AreSimilar(lineA.To, lineB.To, tolerance) )
      || (AreSimilar(lineA.From, lineB.To, tolerance) && AreSimilar(lineA.To, lineB.From, tolerance) )
    ) {
      return true;
    }

    return false;
  }

  // Returns truu if coordinates of points are similar under a threshold value
  bool AreSimilar(Point3d a, Point3d b, double tol) {
    bool similar = Math.Abs(a.X - b.X) < tol
      && Math.Abs(a.Y - b.Y) < tol
      && Math.Abs(a.Z - b.Z) < tol;

    return similar;
  }
# ---------- end c_script_2 ----------
panel_4 = Panel(c_script_2.duplicate)

# ----
python = GhPythonScript(lines=flatten, tolerance=number_slider)  # -> out, cleanLines; inputs lines: list of Line
# ---------- python: Python ----------
__author__ = "Usuario DELL"
__version__ = "2021.04.20"

import rhinoscriptsyntax as rs
import math
import itertools



def RemoveDuplicates(lines, tolerance):
    #Copy original list
    clean = lines
    
    
    
    
    myList = []
    
    
    
    for i in range(0, len(clean)):
        line = clean[i]
        #print(i)
        
        for j in range(len(clean)-1, i, -1):
            other = clean[j]
            #print(other)
            dup = AreDuplicate(line, other, tolerance)
            
            if dup == True:
                
                cl = clean[:].pop(j)
                
                myList.append(cl)
    x1 = list(set(clean) - set(myList))
    return x1


#Returns true if end points of lines are similar under tolerance value
def AreDuplicate(lineA, lineB, tolerance):
    #Compare starting points
    if AreSimilar(lineA.From, lineB.From, tolerance) and AreSimilar(lineA.To, lineB.To, tolerance) or AreSimilar(lineA.From, lineB.To, tolerance) and AreSimilar(lineA.To, lineB.From, tolerance):
        return True
    return False

#Returns truu if coordinates of points are similar under a threshold value 
def AreSimilar(a, b, tol):
    similar = abs(a.X - b.X) < tol and abs(a.Y - b.Y) < tol and abs(a.Z - b.Z) < tol
    return similar



cleanLines = RemoveDuplicates(lines, tolerance)
# ---------- end python ----------
geo_2 = Geometry(python.cleanLines)
panel_5 = Panel(geo_2)

python_2 = GhPythonScript(lineA=crv_2, lineB=crv_3, tolerance=number_slider)  # -> out, duplicate; inputs lineA: Line, lineB: Line
# ---------- python_2: Python ----------
__author__ = "Usuario DELL"
__version__ = "2021.04.20"

import rhinoscriptsyntax as rs

#Returns true if end points of lines are similar under tolerance value
def AreDuplicate(lineA, lineB, tolerance):
    #Compare starting points
    if AreSimilar(lineA.From, lineB.From, tolerance) and AreSimilar(lineA.To, lineB.To, tolerance) or AreSimilar(lineA.From, lineB.To, tolerance) and AreSimilar(lineA.To, lineB.From, tolerance):
        return True
    return False

#Returns truu if coordinates of points are similar under a threshold value 
def AreSimilar(a, b, tol):
    similar = abs(a.X - b.X) < tol and abs(a.Y - b.Y) < tol and abs(a.Z - b.Z) < tol
    return similar

#Output
duplicate = AreDuplicate(lineA, lineB, tolerance)
# ---------- end python_2 ----------
panel_6 = Panel(python_2.duplicate)

lng = ListLength(List=geo)
lng_2 = ListLength(List=geo_2)
panel_7 = Panel(lng_2)
panel_8 = Panel(lng)
