# Grasshopper definition Geometry Gems #11 Point in Local Coordinates_Python.gh (Grasshopper 1.0.7)

# ----
# GEOMETRY GEM SERIES
# 11
# Point in Local Coordinates
# Part 1/1
# By Jose Luis García del Castillo y López @ ParametricCamp
# https://youtu.be/Brf4huewj-A
pt = Point(Point(5.815204877, 5.693807661, 3.937608811))
pt_2 = Point(Point(1.363478435, 6.705313559, 2.526310788))
pt_3 = Point(Point(3.559667199, 5.919532618, 0.9520230702))
pt_4 = Point(Point(1.832022005, 9.668221103, 3.102821068))
pdecon = Deconstruct(Point=pt)  # -> XComponent, YComponent, ZComponent
pl_3pt = Plane3Pt(PointA=pt_2, PointB=pt_3, PointC=pt_4)
panel = Panel(pl_3pt)
panel_2 = Panel([pdecon.XComponent, pdecon.YComponent, pdecon.ZComponent])
c_script = CSharpScript(point=pt, plane=pl_3pt)  # -> out, x, y, z; inputs point: Point3d, plane: Plane
# ---------- c_script: C# ----------
    Point3d p = LocalCoordinates(point, plane);

    x = p.X;
    y = p.Y;
    z = p.Z;
# ---------- c_script: C# additional code ----------
  // Returns the point pt in local coordinates of the CS parameter
  Point3d LocalCoordinates(Point3d pt, Plane cs) {
    Vector3d posVec = pt - cs.Origin;

    double projX = DotProduct(posVec, cs.XAxis);
    double projY = DotProduct(posVec, cs.YAxis);
    double projZ = DotProduct(posVec, cs.ZAxis);

    return new Point3d(projX, projY, projZ);
  }

  // From Geometry Gem #2
  double DotProduct(Vector3d u, Vector3d v) {
    return u.X * v.X + u.Y * v.Y + u.Z * v.Z;
  }
# ---------- end c_script ----------
panel_3 = Panel([c_script.x, c_script.y, c_script.z])

python = GhPythonScript(point=pt, plane=pl_3pt)  # -> out, x, y, z; inputs point: Point3d, plane: Plane
# ---------- python: Python ----------
__author__ = "Usuario DELL"
__version__ = "2021.04.23"

import rhinoscriptsyntax as rs
import Rhino.Geometry as rg


 

def LocalCoordinates(pt, cs):
    posVec = pt - cs.Origin
    
    projX = DotProduct(posVec, cs.XAxis)
    projY = DotProduct(posVec, cs.YAxis)
    projZ = DotProduct(posVec, cs.ZAxis)
    
    
    
    return rg.Point3d(projX, projY, projZ)

def DotProduct(u, v):
    return u.X * v.X + u.Y * v.Y + u.Z * v.Z


#print(p)
p = LocalCoordinates(point, plane)

x = p.X
y = p.Y
z = p.Z
# ---------- end python ----------
panel_4 = Panel([python.x, python.y, python.z])
