# Grasshopper definition Geometry Gems #2 Point to Line Distance_py.gh (Grasshopper 1.0.7)

pt = Point(Point(38.01091009, 35.25994631, 9.730265833))
# GEOMETRY GEMS SERIES
# 02
# Point to Line Distance
# Part 1/1
# By Jose Luis García del Castillo y López @ ParametricCamp
# Video: https://youtu.be/tAWdhUdU8r4
pt_2 = Point(Point(31.14576203, 30.01014633, 10.96795342))
pt_3 = Point(Point(25.79752538, 20.58105022, 0))

ln = Line(StartPoint=pt, EndPoint=pt_3)
crv_cp = CurveClosestPoint(Point=pt_2, Curve=ln)  # -> Point, Parameter, Distance
panel = Panel(crv_cp.Distance)

c_script = CSharpScript(P=pt_2, A=pt, B=pt_3)  # -> out, DDot, DCross; inputs P: Point3d, A: Point3d, B: Point3d
# ---------- c_script: C# ----------
    DDot = distToLineDotProduct(P, A, B);

    DCross = distToLineCrossProduct(P, A, B);
# ---------- c_script: C# additional code ----------
  double distToLineDotProduct(Point3d P, Point3d A, Point3d B) {
    Vector3d AB = B - A;
    AB.Unitize();
    Vector3d AP = P - A;

    double dot = dotProduct(AP, AB);  // length fo the projection of AP over AB
    double lengthAP = AP.Length;

    double h = Math.Sqrt(lengthAP * lengthAP - (dot * dot));

    return h;
  }

  double distToLineCrossProduct(Point3d P, Point3d A, Point3d B) {
    Vector3d AB = B - A;
    Vector3d AP = P - A;

    Vector3d cross = crossProduct(AB, AP);
    double lengthCross = cross.Length;
    double lengthAB = AB.Length;

    double h = lengthCross / lengthAB;

    return h;
  }

  double dotProduct(Vector3d u, Vector3d v) {
    return u.X * v.X + u.Y * v.Y + u.Z * v.Z;
  }

  Vector3d crossProduct(Vector3d u, Vector3d v) {
    double x = u.Y * v.Z - u.Z * v.Y;
    double y = u.Z * v.X - u.X * v.Z;
    double z = u.X * v.Y - u.Y * v.X;

    return new Vector3d(x, y, z);
  }
# ---------- end c_script ----------
panel_2 = Panel([c_script.DDot, c_script.DCross])

python = GhPythonScript(P=pt_2, A=pt, B=pt_3)  # -> out, DDot, DCross; inputs P: Point3d, A: Point3d, B: Point3d
# ---------- python: Python ----------
__author__ = "byroncalgua"

import rhinoscriptsyntax as rs
import math



def distToLineDotProduct(P, A, B):
    AB = B-A
    AB.Unitize()
    AP = P-A

    dot = dotProduct(AP, AB)
    lengthAP = AP.Length
    
    h = math.sqrt(lengthAP * lengthAP - (dot * dot))
    return h
    

def dotProduct(u, v):
    return u.X * v.X + u.Y * v.Y + u.Z * v.Z

DDot = distToLineDotProduct(P, A, B)


def distToLineCrossProduct(P, A, B):
    AB = B-A
    AP = P-A
    
    cross = crossProduct(AB, AP)
    lengthCross = cross.Length
    lengthAB = AB.Length
    
    h = lengthCross/lengthAB
    
    return h


def crossProduct(u, v):
    x = u.Y * v.Z - u.Z * v.Y
    y = u.Z * v.X - u.X * v.Z
    z = u.X * v.Y - u.Y * v.X 
    
    return rs.CreateVector(x,y,z)


DCross = distToLineCrossProduct(P, A, B)
# ---------- end python ----------
panel_3 = Panel([python.DDot, python.DCross])
