# Grasshopper definition Geometry Gems #4 Distance Between 2 Points_py.gh (Grasshopper 1.0.7)

# ----
# GEOMETRY GEMS SERIES
# 04
# Part 1/1
# By Jose Luis García del Castillo y López @ ParametricCamp
# Video: https://youtu.be/Ywc60DT-NBQ
pt = Point(<point referenced from the Rhino model>)
pt_2 = Point(<point referenced from the Rhino model>)

distancebetweenpoints = CSharpScript(A=pt, B=pt_2)  # -> out, D; inputs A: Point3d, B: Point3d
# ---------- distancebetweenpoints: C# ----------
    // Perform calculation
    double d = Distance(A, B);

    // Output it thourhtg the componetn
    D = d;
# ---------- distancebetweenpoints: C# additional code ----------
  double Distance(Point3d a, Point3d b) {
    // Calculate sides of the triangle
    double dx = b.X - a.X;
    double dy = b.Y - a.Y;
    double dz = b.Z - a.Z;

    // Calculate length of the larger side of the triangle
    double d = Math.Sqrt(dx * dx + dy * dy + dz * dz);

    return d;
  }

  double DistanceSquared(Point3d a, Point3d b) {
    // Calculate sides of the triangle
    double dx = b.X - a.X;
    double dy = b.Y - a.Y;
    double dz = b.Z - a.Z;

    // Calculate squared length of the larger side of the triangle
    double d2 = dx * dx + dy * dy + dz * dz;

    return d2;
  }
# ---------- end distancebetweenpoints ----------
panel = Panel(distancebetweenpoints.D)

# ----
# Distance Between 2 Points
dist = Distance(PointA=pt, PointB=pt_2)
panel_2 = Panel(dist)

python = GhPythonScript(A=pt, B=pt_2)  # -> out, D; inputs A: Point3d, B: Point3d
# ---------- python: Python ----------
__author__ = "byroncalgua"

import rhinoscriptsyntax as rs
import math

def Distance(a , b):
    dx = b.X - a.X
    dy = b.Y - a.Y
    dz = b.Z - a.Z
    
    d = math.sqrt(dx * dx + dy * dy + dz * dz)
    
    return d

def DistanceSquared( a, b):
    dx = b.X - a.X
    dy = b.Y - a.Y 
    dz = b.Z - a.Z
    
    #Calculate squared length of the larger side of the triangle
    
    d2 = dx * dx + dy * dy + dz * dz
    
    return d2

d = Distance(A, B)
D = d
# ---------- end python ----------
panel_3 = Panel(python.D)
