# Grasshopper definition Geometry Gems #5 Clean Duplicate Points_Python.gh (Grasshopper 1.0.7)

expression = Expression(x=Slider(5, range=0..100), Expression="Format(\"0 To {0}\", x - 1)")
expression_2 = Expression(x=Slider(5, range=0..100), Expression="Format(\"0 To {0}\", x - 1)")
box = CenterBox(Base=PlaneXY(0, 0, 0), X=1, Y=1, Z=1)
pop3d = Populate3D(Region=box, Count=Slider(1000, range=0..1000), Seed=Slider(1000, range=0..1000))
subset = SubList(List=pop3d, Domain=expression, Wrap=True)  # -> List, Index
subset_2 = SubList(List=pop3d, Domain=expression_2, Wrap=True)  # -> List, Index
pt = Point(flatten(subset.List))
pt_2 = Point(flatten(subset_2.List))
pt_3 = Point(flatten(pop3d))
merge = Merge(Data1=pt, Data2=pt_2, Data3=pt_3)  # -> flatten(Result)
jitter = Jitter(List=merge, Jitter=1, Seed=Slider(100, range=0..100))  # -> Values, Indices
number_slider = Slider(0.018427, range=0..0.1)
pt_4 = Point(jitter.Values)
c_script = CSharpScript(points=pt_4, tolerance=number_slider)  # -> out, cleanPoints; inputs points: list of Point3d, tolerance: Double
# ---------- c_script: C# ----------
    //Go over each point on the list
    for (int i = 0; i < points.Count; i++){
      //Compare with the rest of the points
      //Loop backwards to make sure we don´t skip any item
      for (int j = points.Count - 1; j > i; j--){
        double d = Distance(points[i], points[j]);
        if(d < tolerance){
          //Print(i + is duplicate of" + j);
          points.RemoveAt(j);
        }
      }
    }

    cleanPoints = points;
# ---------- c_script: C# additional code ----------
  //Functions from Geometry Gem #4: Distance between Points

  double Distance(Point3d a, Point3d b){
    //Calculate sides of the triangle
    double dx = b.X - a.X;
    double dy = b.Y - a.Y;
    double dz = b.Z - a.Z;

    //Calculate length of the larger side of the triangle
    double d = Math.Sqrt(dx * dx + dy * dy + dz * dz);

    return d;

  }

  double DistanceSquared(Point3d a, Point3d b){
    //Calculate sides of the triangle
    double dx = b.X - a.X;
    double dy = b.Y - a.Y;
    double dz = b.Z - a.Z;

    //Calculate squared length of the larger side of the triangle
    double d2 = dx * dx + dy * dy + dz * dz;
    return d2;
  }
# ---------- end c_script ----------
c_script_2 = CSharpScript(points=pt_4, tolerance=number_slider)  # -> out, cleanPoints; inputs points: list of Point3d, tolerance: Double
# ---------- c_script_2: C# ----------
    double t2 = tolerance * tolerance; 
    
    //Go over each point on the list
    for (int i = 0; i < points.Count; i++){
      //Compare with the rest of the points
      //Loop backwards to make sure we don´t skip any item
      for (int j = points.Count - 1; j > i; j--){
        double d = Distance(points[i], points[j]);
        if(d < t2){
          //Print(i + is duplicate of" + j);
          points.RemoveAt(j);
        }
      }
    }

    cleanPoints = points;
# ---------- c_script_2: C# additional code ----------
  //Functions from Geometry Gem #4: Distance between Points

  double Distance(Point3d a, Point3d b){
    //Calculate sides of the triangle
    double dx = b.X - a.X;
    double dy = b.Y - a.Y;
    double dz = b.Z - a.Z;

    //Calculate length of the larger side of the triangle
    double d = Math.Sqrt(dx * dx + dy * dy + dz * dz);

    return d;

  }

  double DistanceSquared(Point3d a, Point3d b){
    //Calculate sides of the triangle
    double dx = b.X - a.X;
    double dy = b.Y - a.Y;
    double dz = b.Z - a.Z;

    //Calculate squared length of the larger side of the triangle
    double d2 = dx * dx + dy * dy + dz * dz;
    return d2;
  }
# ---------- end c_script_2 ----------
python = GhPythonScript(points=pt_4, tolerance=number_slider)  # -> out, cleanPoints; inputs points: list of Point3d
# ---------- python: Python ----------
__author__ = "Usuario Dell"
__version__ = "2020.08.08"

import rhinoscriptsyntax as rs
import math

c = len(points)
#print(c)

def Distance(a, b):
    #Calculate sides of the triangle
    dx = b.X - a.X
    dy = b.Y - a.Y
    dz = b.Z - a.Z
    
    d = math.sqrt(dx * dx + dy * dy + dz * dz)
    return d

def DistanceSquared(a , b):
    dx = b.X - a.X
    dy = b.Y - a.Y
    dz = b.Z - a.Z
    
    d2 = dx + dx + dy * dy + dz * dz
    return d2


for i in range(c):
    for j in range(c,-1):
        d2 = DistanceSquared(points[i], points[j])
        if d < t2:
            points.remove(j)

cleanPoints = points
# ---------- end python ----------
python_2 = GhPythonScript(points=pt_4, tolerance=number_slider)  # -> out, cleanPoints; inputs points: list of Point3d
# ---------- python_2: Python ----------
__author__ = "Usuario Dell"
__version__ = "2020.08.08"

import rhinoscriptsyntax as rs
import math

t2 = tolerance * tolerance

c = len(points)
#print(c)

def Distance(a, b):
    #Calculate sides of the triangle
    dx = b.X - a.X
    dy = b.Y - a.Y
    dz = b.Z - a.Z
    
    d = math.sqrt(dx * dx + dy * dy + dz * dz)
    return d

def DistanceSquared(a , b):
    dx = b.X - a.X
    dy = b.Y - a.Y
    dz = b.Z - a.Z
    
    d2 = dx + dx + dy * dy + dz * dz
    return d2


for i in range(c):
    for j in range(c,-1):
        d2 = DistanceSquared(points[i], points[j])
        if d2 < t2:
            points.remove(j)

cleanPoints = points
# ---------- end python_2 ----------
panel = Panel(c_script.cleanPoints)
panel_2 = Panel(c_script_2.cleanPoints)
panel_3 = Panel(python_2.cleanPoints)
panel_4 = Panel(python.cleanPoints)
