# Grasshopper definition Geometry Gems #7 Point Along Line_Python.gh (Grasshopper 1.0.7)

# ----
# 07
# Part 1/1
# By Jose Luis García del Castillo y López @ ParametricCamp
# Video: https://youtu.be/t13LOCz7Cd4
pt = Point(Point(4.981559504, 3.928868893, 0))
pt_2 = Point(Point(13.54013144, 7.72743369, 10.195181))
n = Slider(0.518, range=0..1)
d = Slider(5.437, range=0..10)

# ----
# GEOMETRY GEMS SERIES
# Point Along Line
ln = Line(StartPoint=pt, EndPoint=pt_2)

python = GhPythonScript(A=pt, B=pt_2, n=n)  # -> out, C; inputs A: Point3d, B: Point3d
# ---------- python: Python ----------
__author__ = "Usuario DELL"
__version__ = "2021.04.19"

import rhinoscriptsyntax as rs
import Rhino 


#This function returns a point at a relative distance t Between points a and b

def PointAlongLine(a, b, t):
    #Find relative distances between points
    dx = b.X - a.X
    dy = b.Y - a.Y
    dz = b.Z - a.Z
    
    #Compute relative distance for c
    nx = t * dx
    ny = t * dy
    nz = t * dz
    
    
    #Compute relative world coordinates for c
    cx = a.X + nx
    cy = a.Y + ny
    cz = a.Z + nz
    
    #Compute c point
    
    #c = Rhino.Geometry.Point3d(cx, cy, cz)
    
    #Doing it the 'vector algebra' way ;)
    
    AB = b - a
    AC = t * AB
    
    c = a + AC
    
    return c




#Output
C = PointAlongLine(A, B, n)
# ---------- end python ----------
python_2 = GhPythonScript(A=pt, B=pt_2, n=n)  # -> out, C; inputs A: Point3d, B: Point3d
# ---------- python_2: Python ----------
__author__ = "Usuario DELL"
__version__ = "2021.04.19"

import rhinoscriptsyntax as rs
import Rhino 


#This function returns a point at a relative distance t Between points a and b

def PointAlongLine(a, b, t):
    #Find relative distances between points
    dx = b.X - a.X
    dy = b.Y - a.Y
    dz = b.Z - a.Z
    
    #Compute relative distance for c
    nx = t * dx
    ny = t * dy
    nz = t * dz
    
    
    #Compute relative world coordinates for c
    cx = a.X + nx
    cy = a.Y + ny
    cz = a.Z + nz
    
    #Compute c point
    
    c = Rhino.Geometry.Point3d(cx, cy, cz)
    
    return c




#Output
C = PointAlongLine(A, B, n)
# ---------- end python_2 ----------

python_3 = GhPythonScript(A=pt, B=pt_2, d=d)  # -> out, C; inputs A: Point3d, B: Point3d
# ---------- python_3: Python ----------
__author__ = "Usuario DELL"
__version__ = "2021.04.19"

import rhinoscriptsyntax as rs
import Rhino
import math

#This function returns a point at an absolute Euclidean distance d Between points a and b

def PointAlongLineAbsolute(a, b, d):
    D = Distance(a, b)
    n = d / D
    
    p = PointAlongLineRelative(a, b, n)
    return p

#This function returns a point at a relative distance t between points a and b
def PointAlongLineRelative(a, b, t):
    #Find relative distance between points
    dx = b.X - a.X
    dy = b.Y - a.Y
    dz = b.Z - a.Z
    
    #Compute relative distances for c
    nx = t * dx
    ny = t * dy 
    nz = t * dz
    
    #Compute world coordinates for c
    cx = a.X + nx
    cy = a.Y + ny
    cz = a.Z + nz
    
    #Compute c point
    c = Rhino.Geometry.Point3d(cx, cy, cz)
    
    return c

#Distance between 2 points (Geometry Gem#4)
def Distance(a, b):
    #Calculate sides of the triangle
    dx = b.X - a.X
    dy = b.Y - a.Y
    dz = b.Z - a.Z
    
    #Calculate length of the larger side of the triangle
    d = math.sqrt(dx * dx + dy * dy + dz *dz)
    return d

#Output
C = PointAlongLineAbsolute(A, B, d)
# ---------- end python_3 ----------
python_4 = GhPythonScript(A=pt, B=pt_2, d=d)  # -> out, C; inputs A: Point3d, B: Point3d
# ---------- python_4: Python ----------
__author__ = "Usuario DELL"
__version__ = "2021.04.19"

import rhinoscriptsyntax as rs
import Rhino
import math

#This function returns a point at an absolute Euclidean distance d Between points a and b

def PointAlongLineAbsolute(a, b, d):
    D = Distance(a, b)
    n = d / D
    
    p = PointAlongLineRelative(a, b, n)
    return p

#This function returns a point at a relative distance t between points a and b
def PointAlongLineRelative(a, b, t):
    #Find relative distance between points
    dx = b.X - a.X
    dy = b.Y - a.Y
    dz = b.Z - a.Z
    
    #Compute relative distances for c
    nx = t * dx
    ny = t * dy 
    nz = t * dz
    
    #Compute world coordinates for c
    cx = a.X + nx
    cy = a.Y + ny
    cz = a.Z + nz
    
    #Compute c point
    #c = Rhino.Geometry.Point3d(cx, cy, cz)
    
    #Doing it the 'vector algebra' way ;)
    AB = b - a
    AC = t * AB
    c = a + AC
    
    return c

#Distance between 2 points (Geometry Gem#4)
def Distance(a, b):
    #Calculate sides of the triangle
    dx = b.X - a.X
    dy = b.Y - a.Y
    dz = b.Z - a.Z
    
    #Calculate length of the larger side of the triangle
    d = math.sqrt(dx * dx + dy * dy + dz *dz)
    return d

#Output
C = PointAlongLineAbsolute(A, B, d)
# ---------- end python_4 ----------

c_script = CSharpScript(A=pt, B=pt_2, n=n)  # -> out, C; inputs A: Point3d, B: Point3d, n: Double
# ---------- c_script: C# ----------
    // Output
    C = PointAlongLine(A, B, n);
# ---------- c_script: C# additional code ----------
  
  // This function returns a point at a relative distance t
  // between points a and b.
  Point3d PointAlongLine(Point3d a, Point3d b, double t) {
    // Find relative distances between points
    double dx = b.X - a.X;
    double dy = b.Y - a.Y;
    double dz = b.Z - a.Z;
  
    // Compute relative distances for c
    double nx = t * dx;
    double ny = t * dy;
    double nz = t * dz;
  
    // Compute world coordinates for c
    double cx = a.X + nx;
    double cy = a.Y + ny;
    double cz = a.Z + nz;

    // Compute c point
    Point3d c = new Point3d(cx, cy, cz);

    // // Doing it the 'vector algebra' way ;)
    //    Vector3d AB = b - a;
    //    Vector3d AC = t * AB;
    //    Point3d c = a + AC;

    return c;
  }
# ---------- end c_script ----------
c_script_2 = CSharpScript(A=pt, B=pt_2, d=d)  # -> out, C; inputs A: Point3d, B: Point3d, d: Double
# ---------- c_script_2: C# ----------
    // Output
    C = PointAlongLineAbsolute(A, B, d);
# ---------- c_script_2: C# additional code ----------
  // This function returns a point at an absolute Euclidean distance d
  // between points a and b.
  Point3d PointAlongLineAbsolute(Point3d a, Point3d b, double d) {
    double D = Distance(a, b);
    double n = d / D;

    Point3d p = PointAlongLineRelative(a, b, n);

    return p;
  }

  // This function returns a point at a relative distance t
  // between points a and b.
  Point3d PointAlongLineRelative(Point3d a, Point3d b, double t) {
    // Find relative distances between points
    double dx = b.X - a.X;
    double dy = b.Y - a.Y;
    double dz = b.Z - a.Z;

    // Compute relative distances for c
    double nx = t * dx;
    double ny = t * dy;
    double nz = t * dz;

    // Compute world coordinates for c
    double cx = a.X + nx;
    double cy = a.Y + ny;
    double cz = a.Z + nz;

    // Compute c point
    Point3d c = new Point3d(cx, cy, cz);

    // // Doing it the 'vector algebra' way ;)
    //    Vector3d AB = b - a;
    //    Vector3d AC = t * AB;
    //    Point3d c = a + AC;

    return c;
  }

  // Distance between 2 points (Geometry Gem #4)
  double Distance(Point3d a, Point3d b) {
    // Calculate sides of the triangle
    double dx = b.X - a.X;
    double dy = b.Y - a.Y;
    double dz = b.Z - a.Z;

    // Calculate length of the larger side of the triangle
    double d = Math.Sqrt(dx * dx + dy * dy + dz * dz);

    return d;
  }
# ---------- end c_script_2 ----------

pt_3 = Point(c_script_2.C)
pt_4 = Point(python_2.C)
# Vector algebra way
pt_5 = Point(python.C)
pt_6 = Point(python_3.C)
# Vector algebra way
pt_7 = Point(python_4.C)
