# Grasshopper definition Geometry Gems #8 Chaikins Algorithm_Python.gh (Grasshopper 1.0.7)

number_slider = Slider(6, range=0..10)
toggle = BooleanToggle(True)
number_slider_2 = Slider(0.25, range=0..1)
# GEOMETRY GEMS SERIES
# 08
# Chaikin's Algorithm for Polyline Smoothing
# Part 1/1
# By Jose Luis García del Castillo y López @ ParametricCamp
# Video: https://youtu.be/SzRsPqG_94w
pt = Point([Point(13.54954385, 8.973346329, 0), Point(8.564305829, 18.58360091, 0), Point(17.28618143, 22.40074796, 13.08531022), Point(21.65121562, 7.425210866, 0), Point(39.5640788, 13.24841827, 0), Point(30.34991363, 40.44256953, 6.215730703)])

chaikin_s_algorithm = CSharpScript(pts=pt, iterations=number_slider, prop=number_slider_2, periodic=toggle)  # -> out, ptsOut; inputs pts: list of Point3d, iterations: Int32, prop: Double, periodic: Boolean
# ---------- chaikin_s_algorithm: C# ----------
    // Create our working list of points (clone)
    List<Point3d> ctrlPts = new List<Point3d>(pts);

    // Duplicate points for a peridic curve
    if (periodic) {
      ctrlPts.Add(ctrlPts[0]);
      ctrlPts.Add(ctrlPts[1]);
    }

    // Iterations of smoothing
    for (int i = 0; i < iterations; i++) {
      ctrlPts = SmoothPolyline(ctrlPts, prop);
    }

    // Remove the last duplicate point
    if (periodic) {
      ctrlPts.RemoveAt(ctrlPts.Count - 1);
    }

    // Output
    ptsOut = ctrlPts;
# ---------- chaikin_s_algorithm: C# additional code ----------
  // Returns a list of smoothed ctrl points for the polyline
  List<Point3d> SmoothPolyline(List<Point3d> pts, double t) {
    // Empty list to populate with new pts
    List<Point3d> newPts = new List<Point3d>();

    // Compute the relative parameters of the points
    double t0 = t;
    double t1 = 1 - t;

    // Find the two control points for each line segment
    for (int i = 1; i < pts.Count; i++) {
      Point3d A = pts[i - 1];
      Point3d B = pts[i];

      Point3d p0 = PointAlongLine(A, B, t0);
      Point3d p1 = PointAlongLine(A, B, t1);

      newPts.Add(p0);
      newPts.Add(p1);
    }

    return newPts;
  }


  // FROM GEOMETRY GEM #7
  // This function returns a point at a relative distance t
  // between points a and b.
  Point3d PointAlongLine(Point3d a, Point3d b, double t) {
    // Find relative distances between points
    double dx = b.X - a.X;
    double dy = b.Y - a.Y;
    double dz = b.Z - a.Z;

    // Compute relative distances for c
    double nx = t * dx;
    double ny = t * dy;
    double nz = t * dz;

    // Compute world coordinates for c
    double cx = a.X + nx;
    double cy = a.Y + ny;
    double cz = a.Z + nz;

    // Compute c point
    Point3d c = new Point3d(cx, cy, cz);

    return c;
  }
# ---------- end chaikin_s_algorithm ----------
python = GhPythonScript(pts=pt, iterations=number_slider, prop=number_slider_2, periodic=toggle)  # -> out, ptsOut; inputs pts: list of Point3d, iterations: Int32, periodic: Boolean
# ---------- python: Python ----------
__author__ = "Usuario DELL"
__version__ = "2021.04.19"

import rhinoscriptsyntax as rs
import Rhino


#FROM GEOMETRY GEM #7
#This function returns a point at a relative distance t between points a and b
def PointAlongLine(a, b, t):
    #Find relative distances between points
    dx = b.X - a.X
    dy = b.Y - a.Y
    dz = b.Z - a.Z
    
    #Compute relative distances for c
    nx = t * dx
    ny = t * dy
    nz = t * dz
    
    #Compute world coordinates for c
    cx = a.X + nx
    cy = a.Y + ny
    cz = a.Z + nz
    
    #Compute c point
    c = Rhino.Geometry.Point3d(cx, cy, cz)
    return c

#Returns a list of smoothed ctrl points for the polyline
def SmoothPolyline(pts, t):
    #Empty list to populate with new pts
    newPts = []
    
    #Compute the relative parameters of the points
    t0 = t
    t1 = 1-t
    #Find the two control points for each line segment
    for i in range(1, len(pts)):
        A = pts[i - 1]
        B = pts[i]
        p0 = PointAlongLine(A, B, t0)
        p1 = PointAlongLine(A, B, t1)
        newPts.Add(p0)
        newPts.Add(p1)
    return newPts



#Create our working list of points (clone)
ctrlPts = pts

print(ctrlPts)

#Duplicate points for a periodic curve
if periodic == True:
    ctrlPts.Add(ctrlPts[0])
    ctrlPts.Add(ctrlPts[1])

for i in range(0, iterations):
    ctrlPts = SmoothPolyline(ctrlPts, prop)

#Temove the las duplicate point
if periodic == True:
    ctrlPts[:len(ctrlPts)-1]


ptsOut = ctrlPts
# ---------- end python ----------
pline = PolyLine(Vertices=pt, Closed=False)

pt_2 = Point(chaikin_s_algorithm.ptsOut)
pline_2 = PolyLine(Vertices=pt_2, Closed=False)

pt_3 = Point(python.ptsOut)
pline_3 = PolyLine(Vertices=pt_3, Closed=False)
