# Grasshopper definition labACD-RecursiveFunctions-CSharp-v2_py.gh (Grasshopper 1.0.7)

# ---- group: labADC-Repetion-NesteLoop.gh
# // Function  Nested Loop
number_slider = Slider(0.28, range=0..1)
number_slider_2 = Slider(6, range=0..10)
crv = Curve(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)
c_script = CSharpScript(polyline=crv, t=number_slider, n=number_slider_2)  # -> out, A; inputs polyline: Polyline, t: Double, n: Int32
# ---------- c_script: C# ----------
    A = PolySubdivision(polyline, n, t);
# ---------- c_script: C# additional code ----------
  // C# code by Andres Obregon

  List<Polyline> PolySubdivision (Polyline initialPolyline, int repetitions, double t)
  {
    // Empty List to collect the Polylines
    List < Polyline > polylines = new List<Polyline> ();
    if(t > 1){t = 1;} if (t < 0){t = 0;} //t (0.0 to 1.0)
    polylines.Add(initialPolyline);
    Polyline firstPolyline = initialPolyline;

    List<Point3d> ptSegment = new List<Point3d>();

    int nPolySegments = initialPolyline.Count - 1;
    Print(nPolySegments.ToString());

    for (int k = 0; k < repetitions ; k++)
    {


      // Segments Array
      Line [] rSegments = new Line [nPolySegments];
      rSegments = firstPolyline.GetSegments();


      // Point3d Segments
      for (int j = 0; j < rSegments.Length; j++)
      {
        //Print("segement");
        ptSegment.Add(rSegments[j].PointAt(t));
        // Add first Point to close the Polyline
      }

      ptSegment.Add(ptSegment[0]); // ClosePolyline

      // Draw the Polyline
      Polyline secondPoly = new Polyline(ptSegment);
      // Add the new Polyline to the List
      polylines.Add(secondPoly);
      // Update the firt Polyline
      firstPolyline = secondPoly;
      //Clear the list of points
      ptSegment.Clear();

    }


    return polylines;
  }
# ---------- end c_script ----------
crv_2 = Curve(c_script.A)
panel = Panel(crv_2)

# ----
ghpython_script = GhPythonScript(polyline=crv, t=number_slider, n=number_slider_2)  # -> out, A; inputs polyline: Polyline, n: Int32
# ---------- ghpython_script: Python ----------
import rhinoscriptsyntax as rs
import Rhino.Geometry as rg

def PolySubdivision(initialPolyline, repetitions, t):
    polylines = []
    
    if t > 1:
        t = 1.00
    if t < 0:
        t = 0.00
    
    polylines.append(initialPolyline)
    firstPolyline = initialPolyline
    
    ptSegment = []
    
    nPolySegments = initialPolyline.Count - 1
    print(nPolySegments)
    
    for k in range(0, repetitions):
        
        #Segments Array
        rSegments = firstPolyline.GetSegments()
        
        #Point3D Segments
        for j in range(0, len(rSegments)):
            ptSegment.append(rSegments[j].PointAt(t))
            
            #Add first Point to close the Polyline
        
        #ClosePolyline
        ptSegment.append(ptSegment[0])
        
        #Draw the Polyline
        secondPoly = rg.Polyline(ptSegment)
        
        #Add the new Polyline to the List
        polylines.Add(secondPoly)
        
        #Update the first Polyline
        firstPolyline = secondPoly
        
        #Clear the list of points
        
        ptSegment.Clear()
    return polylines

A = PolySubdivision(polyline, n, t)
# ---------- end ghpython_script ----------
curve = Curve(ghpython_script.A)
panel_2 = Panel(curve)

number_slider_3 = Slider(1, range=0..1)
c_script_2 = CSharpScript()  # -> out, A, B
# ---------- c_script_2: C# ----------
    Print("Hello!");
    
    Point3d a = new Point3d(0, 10, 0);
    Point3d b = new Point3d(10, 10, 0);
    
    A = a;
    B = b;
# ---------- end c_script_2 ----------

c_script_3 = CSharpScript(t=number_slider_3)  # -> out, A, B; inputs t: Double
# ---------- c_script_3: C# ----------
    Print("Hello!");
    
    double x = 0;
    double y = 15;
    double z = 0;
    
    Point3d a = new Point3d(x, y, z);
    Point3d b = new Point3d(x+15, y, z);
    
    Line ln0 = new Line(a, b);
    
    Point3d ptT = ln0.PointAt(t);
    
    A = ln0;
    B = ptT;
# ---------- end c_script_3 ----------
line = Line(c_script_3.A)
pt = Point(c_script_3.B)

c_script_4 = CSharpScript()  # -> out, A, B
# ---------- c_script_4: C# ----------
    Print("Hello!");
    Point3d a = new Point3d(0, 10, 0);
    Point3d b = new Point3d(10, 10, 0);
    Line ln0 = new Line(a, b);
    Point3d ptT = ln0.PointAt(0.5);//
    A = ln0;
    B = ptT;
# ---------- end c_script_4 ----------
line_2 = Line(c_script_4.A)
pt_2 = Point(c_script_4.B)

panel_3 = Panel("https://natureofcode.com/book/chapter-8-fractals/")

# ----
# What would happen if we called the function we are defining within the function itself? Can someFunction() call someFunction()?
# 
# Show Raw
# void someFunction() {
#   someFunction();
# }
# // Make a Polyline from a List of Points
# // Make a List of Points At (t) parmater on each segment Line
# // Make a List of n Polylines inside an input Polyline
# // Make a Functions for each action
panel_4 = Panel("https://natureofcode.com/book/chapter-8-fractals/")

panel_5 = Panel("2Do!")

ghpython_script_2 = GhPythonScript()  # -> out, A, B
# ---------- ghpython_script_2: Python ----------
import rhinoscriptsyntax as rs
import Rhino.Geometry as rg

a = rg.Point3d(0, 10, 0)
b = rg.Point3d(10, 10, 0)


#Output
A = a
B = b
# ---------- end ghpython_script_2 ----------
ghpython_script_3 = GhPythonScript()  # -> out, A, B
# ---------- ghpython_script_3: Python ----------
import rhinoscriptsyntax as rs
import Rhino.Geometry as rg

print("Hello!")

a = rg.Point3d(0, 10, 0)
b = rg.Point3d(10, 10, 0)

#Draw line
ln0 = rg.Line(a, b)

#Point on curve
ptT = ln0.PointAt(0.5)

#Output
A = ln0
B = ptT
# ---------- end ghpython_script_3 ----------
ghpython_script_4 = GhPythonScript(t=number_slider_3)  # -> out, A, B
# ---------- ghpython_script_4: Python ----------
import rhinoscriptsyntax as rs
import Rhino.Geometry as rg

print("Hello!")

x = 0.00
y = 15.00
z = 0.00

a = rg.Point3d(x, y, z)
b = rg.Point3d(x + 15, y, z)

#Draw line
ln0 = rg.Line(a, b)

#Point on curve 
ptT = ln0.PointAt(t)

A = ln0
B = ptT
# ---------- end ghpython_script_4 ----------
panel_6 = Panel(ghpython_script_3.out)
panel_7 = Panel(ghpython_script_4.out)
point = Point(ghpython_script_2.A)
point_2 = Point(ghpython_script_2.B)
line_3 = Line(ghpython_script_3.A)
point_3 = Point(ghpython_script_4.B)
point_4 = Point(ghpython_script_3.B)
line_4 = Line(ghpython_script_4.A)

# ----
# // Repetition in a Recursion Function
number_slider_4 = Slider(0.163, range=0..1)
n = Slider(57, range=0..70)
toggle = BooleanToggle(True)
toggle_2 = BooleanToggle(True)
pt_3 = Point([Point(60, 20, 0), Point(50, 30, 0), Point(50, 40, 0), Point(50.29943403, 60.05851646, 0), Point(74.73956369, 60.06244198, 0), Point(80, 45.6226577, 0), Point(79.77208518, 30.21154654, 0), Point(75.32064655, 18.25819706, 0)])
c_polylinerecursiveloop = CSharpScript(points=pt_3, close=toggle_2, info=toggle, t=number_slider_4, n=n)  # -> out, A; inputs points: list of Point3d, close: Boolean, info: Boolean, t: Double, n: Int32
# ---------- c_polylinerecursiveloop: C# ----------
    //Lab adc,  Jam Coding "Recursive Functions" FAB16 MTL
    //C# code by Andres Obregon
    
    Print("Hello Jam Coding Recursive Functions");
    Print("Let's Code! ");

    if(points.Count < 1)
    {
      this.Component.AddRuntimeMessage(GH_RuntimeMessageLevel.Error, "Empty List<Point3d>, Input Points!");
    }

    //Polyline poly = Poly(points, close, info);
    //List<Point3d> newPoints = NewPointsAtT(poly, t);
    //Polyline newPoly = Poly(newPoints, close, false);


    //- Declare and empty List to collect all the Polylines
    List <Polyline> newPolylines = new List <Polyline>();
    //- Call our Function to Make the first Polyline from a List of Points
    Polyline poly = MakePolyline(points, close);

    if (info)
    {
      Print("Polyline Length is = " + poly.Length.ToString());                     // Polyline Length
      Print("Thenumber of segments are: " + poly.SegmentCount.ToString());         // Number of segments
      Print("The Number of Points are: " + poly.Count.ToString());                 // Number of Points
    }



    //- Add the first Polyline to the List
    newPolylines.Add(poly);


    //-Outputs
    //P = poly;
    //newPts = newPoints;//NewPointsAtT(poly, t);
    //newPly = newPoly;

    // A = PolylineRecursiveLoop(poly, 7, t);

    A = PolylineRecursiveLoop(newPolylines, close, n, t);
# ---------- c_polylinerecursiveloop: C# additional code ----------
  //- Make a Polyline from a List of Points
  Polyline MakePolyline(List<Point3d> points, bool close)
  {

    // Close the Polyline
    if (close)
    {
      // Add the first point at the end of the List of Point3d
      points.Add(points[0]);
    }

    Polyline poly = new Polyline(points);

    return poly;
  }

  //- Make a List of Points At (t) parmater on each segment Line
  List<Point3d> MakePointsAtT (Polyline firstPolyline, double t)
  {
    List <Point3d> newPoints = new List <Point3d>();
    for (int i = 0 ; i < firstPolyline.SegmentCount; i++)
    {

      //Print("I find line " + i.ToString());
      //- Declare and initialize an empty array in C#
      Line[] lines = new Line[]{};
      //- Get all the segments lines of the polyline into the array of lines
      lines = firstPolyline.GetSegments();

      newPoints.Add(lines[i].PointAt(t));
    }
    return newPoints;
  }


  //- Make a Recursive Function to genereta a List of n Polylines inside an input Polyline
  List<Polyline> PolylineRecursiveLoop(List <Polyline> newPolylines, bool close, int nRepetitions, double t)
  {

    Polyline firstPolyline = newPolylines[newPolylines.Count - 1]; // Add the first Polyline

    //- Call our Function to Make a List of Points At (t) parmater on each segment Line of the Polyline
    List<Point3d> newPoints = MakePointsAtT(firstPolyline, t);


    //- Call our Function to Make a Polyline from the List of Points
    Polyline newPoly = MakePolyline(newPoints, close);

    //- Add the new Polyline to the List
    newPolylines.Add(newPoly);

    //- Decrement numbers of repetions
    nRepetitions = nRepetitions - 1;


    //- Get all the segments lines of the polyline into the array of lines
    Line[] lines = newPoly.GetSegments();
    // Condition for minimum segement Length
    double minimumLenght = 0.5; //Define the minimum segment dimension
    for (int i = 0 ; i < newPoly.SegmentCount; i++)
    {
      if (lines[i].Length <= minimumLenght) //
        return newPolylines;
    }
    //- Condition to check if we have just one line segment!
    //Print("found " + newPoints.Count.ToString() + " points ");
    // Condition to check if we have just one line segment!
    if (newPoints.Count <= 2 )return newPolylines;


    //- Condition to stop the repetion
    if((nRepetitions >= 1))
    {
      //Print("Lets call again the PolylineRecursiveLoop function!");

      firstPolyline = newPoly;
      newPoints.Clear();

      //- RECURSIVE function Call again the PolylineRecursiveLoop
      PolylineRecursiveLoop(newPolylines, close, nRepetitions, t);
    }



    return newPolylines;
  }
# ---------- end c_polylinerecursiveloop ----------
panel_8 = Panel(c_polylinerecursiveloop.out)
crv_3 = Curve(c_polylinerecursiveloop.A)
panel_9 = Panel(crv_3)

ghpython_script_5 = GhPythonScript(points=pt_3, close=toggle_2, info=toggle, t=number_slider_4, n=n)  # -> out, A; inputs points: list of Point3d, close: Boolean, info: Boolean, n: Int32
# ---------- ghpython_script_5: Python ----------
import rhinoscriptsyntax as rs
import Rhino.Geometry as rg
import Grasshopper.Kernel as gh

newPoints = []
newPolylines = []


e = gh.GH_RuntimeMessageLevel.Error

#Make a Recursive Function to generate a List of n Polylines inside an input Polyline
def PolylineRecursiveLoop(newPolylines, close, nRepetitions, t):
    #print(newPolylines.Count)
    
    firstPolyline = newPolylines[newPolylines.Count - 1]
    
    #Call our Function to Make a List of Points At (t)
    newPoints = MakePointsAtT(firstPolyline, t)
    
    
    #Call our Function to Make a Polyline from the list of points
    newPoly = MakePolyline(newPoints, close)
    
    #Add the new Polyline to the List
    newPolylines.Add(newPoly)
    
    #Decrement numbers of repetitions
    nRepetitions = nRepetitions - 1
    
    #Get all the segments lines of the polyline into th earray of lines
    lines = newPoly.GetSegments()
    
    #Conditions for minumum segment Length
    minimumLength = 0.5 
    for i in range(0, newPoly.SegmentCount):
        if lines[i].Length <= minimumLength:
            return newPolylines
    
    #Condition to check if we have just one line segment
    if newPoints.Count <= 2:
        return newPolylines
    
    #Condition to stop repetition
    if nRepetitions >= 1:
        #Print(Let's call again the PolylineRecursiveLoop function!")
        
        firstPolyline = newPoly
        newPoints.Clear()
        
        #Recursive function call again the PolylineRecursiveLoop
        PolylineRecursiveLoop(newPolylines, close, nRepetitions, t)
    
    return newPolylines



def MakePolyline(points, close):
    #Close the Polyline
    if close == True:
        #Add the first point at the end of the List of Point3d
        #print(points)
        points.Add(points[0])
        
    
    poly = rg.Polyline(points)
    
    return poly

#Make a List of Points At (t) parameter on each segment Line
def MakePointsAtT(firstPolyline, t):
    newPoints = []
    for i in range(0, firstPolyline.SegmentCount):
        #print("I find line", i)
        
        #Declare and initialize an empty array in C#
        lines = []
        lines = firstPolyline.GetSegments()
        newPoints.Add(lines[i].PointAt(t))
    return newPoints


print("Hello Jam Coding Recursive Functions")
print("Let's Code")

poly = MakePolyline(points, close)

if info == True:
    print("Polyline Length is = {0}".format(poly.Length))
    print("The number of Segments are: {0}".format(poly.SegmentCount))
    print("The number of Points are: {0}".format(poly.Count))


if points.Count < 1:
    print(e)

#Add the first Polyline to the List
newPolylines.Add(poly)

A = PolylineRecursiveLoop(newPolylines, close, n, t)
# ---------- end ghpython_script_5 ----------
curve_2 = Curve(ghpython_script_5.A)
panel_10 = Panel(ghpython_script_5.out)
panel_11 = Panel(curve_2)

pt_4 = Point([Point(40, 0, 0), Point(30, 10, 0), Point(30, 20, 0), Point(50, 20, 0), Point(50, 10, 0)])
number_slider_5 = Slider(1, range=0..1)
number_slider_6 = Slider(0.9, range=0..1)
toggle_3 = BooleanToggle(True)

# ----
# // Function  Nested Loop
c_script_5 = CSharpScript(points=pt_4, close=Toggle(False), t=Slider(0.6, range=0..1), n=Slider(6, range=0..10))  # -> out, A; inputs points: list of Point3d, close: Boolean, t: Double, n: Int32
# ---------- c_script_5: C# additional code ----------
  //C# code by Andres Obregon
# ---------- end c_script_5 ----------
crv_4 = Curve(c_script_5.A)

c_script_6 = CSharpScript(points=pt_4, t=number_slider_6)  # -> out, L, Pt, P; inputs points: list of Point3d, t: Double
# ---------- c_script_6: C# ----------
    Print("Hello! Let's draw a Polyline");

        /*

    Point3d a = new Point3d(0, 10, 0);
    Point3d b = new Point3d(15, 10, 0);
    Line ln0 = new Line(a, b);
    Point3d ptT = ln0.PointAt(t);//
    L = ln0;
    Pt = ptT;
    */

    Polyline poly = new Polyline(points);
    P = poly;
# ---------- end c_script_6 ----------
line_5 = Line(c_script_6.L)
pt_5 = Point(c_script_6.Pt)

c_script_7 = CSharpScript(points=pt_4, close=Toggle(False), t=number_slider_6)  # -> out, L, Pt, P; inputs points: list of Point3d, close: Boolean, t: Double
# ---------- c_script_7: C# ----------
    Print("Hello, Let's close a Polyline");

            /*

    Point3d a = new Point3d(0, 10, 0);
    Point3d b = new Point3d(15, 10, 0);
    Line ln0 = new Line(a, b);
    Point3d ptT = ln0.PointAt(t);//
    L = ln0;
    Pt = ptT;
    */

    //bool close = true;
    if (close)
    {
      points.Add(points[0]);
    }

    Polyline poly = new Polyline(points);

    P = poly;
# ---------- end c_script_7 ----------
line_6 = Line(c_script_7.L)
pt_6 = Point(c_script_7.Pt)

c_script_8 = CSharpScript(points=pt_4, close=toggle_3, t=number_slider_5)  # -> out, L, Pt, P, Lns, newPts, newPly; inputs points: list of Point3d, close: Boolean, t: Double
# ---------- c_script_8: C# ----------
        Print("Hello, Let's draw a new Polyline!");
        /*
   

    Point3d a = new Point3d(0, 10, 0);
    Point3d b = new Point3d(15, 10, 0);

    Line ln0 = new Line(a, b);

    Point3d ptT = ln0.PointAt(t);//

     // Outputs
    L = ln0;
    Pt = ptT;
    */

    //--------------------------------------------------------------------


    if (close)
    {
      points.Add(points[0]);
    }

    Polyline poly = new Polyline(points);

    Print("Polyline Length is = " + poly.Length.ToString());                     // Polyline Length
    Print("Thenumber of segments are: " + poly.SegmentCount.ToString());         // Number of segments
    Print("The Number of Points are: " + poly.Count.ToString());                // Number of Points

    Line[] lines = poly.GetSegments();

    List <Point3d> newPoints = new List <Point3d>();
    for (int i = 0 ; i < poly.SegmentCount; i++)// poly.Count-1
    {
      Print("I find line " + i.ToString());
      newPoints.Add(lines[i].PointAt(t));
    }

    if (close)
    {
      newPoints.Add(newPoints[0]);
    }
    Polyline newPoly = new Polyline(newPoints);

    // Outputs

    P = poly;
    Lns = lines; //lines[0];//
    newPts = newPoints;
    newPly = newPoly;

    //--------------------------------------------------------------------
# ---------- end c_script_8 ----------
line_7 = Line(c_script_8.L)
pt_7 = Point(c_script_8.Pt)
crv_5 = Curve(c_script_8.newPly)

crv_6 = Curve(c_script_8.P)
pt_8 = Point(c_script_8.newPts)
crv_7 = Curve(c_script_8.Lns)
len = Length(Curve=crv_6)
panel_12 = Panel(c_script_7.out)
panel_13 = Panel(c_script_8.out)
panel_14 = Panel(c_script_6.out)

ghpython_script_6 = GhPythonScript(points=pt_4, t=number_slider_6)  # -> out, L, Pt, P; inputs points: tree
# ---------- ghpython_script_6: Python ----------
import rhinoscriptsyntax as rs
import Rhino.Geometry as rg

print("Hello! Let's draw a Polyline")

a = rg.Point3d(0, 10, 0)
b = rg.Point3d(15, 0, 0)

ln0 = rg.Line(a, b)
ptT = ln0.PointAt(t)

L = ln0
Pt = ptT
# ---------- end ghpython_script_6 ----------
point_5 = Point(ghpython_script_6.Pt)

line_8 = Line(ghpython_script_6.L)
panel_15 = Panel(ghpython_script_6.out)

ghpython_script_7 = GhPythonScript(points=pt_4, close=toggle_3, t=number_slider_5)  # -> out, L, Pt, P, Lns, newPts, newPly; inputs points: list of Point3d, close: Boolean
# ---------- ghpython_script_7: Python ----------
import rhinoscriptsyntax as rs
import Rhino.Geometry as rg

if close == True:
    points.Add(points[0])

poly = rg.Polyline(points)


print('Polyline Length is = ' , poly.Length)
print('The number of segments are: ', poly.SegmentCount)
print('The number of Points are: ', poly.Count)

lines = poly.GetSegments()


newPoints = []

for i in range(0, poly.SegmentCount):
    #print('I find line:', + i)
    newPoints.append(lines[i].PointAt(t))

if close == True:
    newPoints.append(newPoints[0])

newPoly = rg.PolylineCurve(newPoints)


#Outputs
P = rg.PolylineCurve(poly)
Lns = lines
newPts = newPoints
newPly = newPoly
# ---------- end ghpython_script_7 ----------
line_9 = Line(ghpython_script_7.L)
point_6 = Point(ghpython_script_7.Pt)
crv_8 = Curve(ghpython_script_7.Lns)
point_7 = Point(ghpython_script_7.newPts)
curve_3 = Curve(ghpython_script_7.newPly)
curve_4 = Curve(ghpython_script_7.P)

length = Length(Curve=curve_4)
panel_16 = Panel(ghpython_script_7.out)

# ----
# // Repetition in a Nested Loop
toggle_4 = BooleanToggle(False)
n_2 = Slider(39, range=0..40)

c_script_9 = CSharpScript(points=pt_4, close=toggle_4, t=Slider(0.6, range=0..1), n=Slider(6, range=0..10))  # -> out, L, Pt, P, Lns, newPts, newPly, A; inputs points: list of Point3d, close: Boolean, t: Double, n: Int32
# ---------- c_script_9: C# ----------
    // Print("Hello, Let's draw a List of  Polylines !");
    //C# code by Andres Obregon


    Point3d a = new Point3d(0, 10, 0);
    Point3d b = new Point3d(15, 10, 0);

    Line ln0 = new Line(a, b);

    Point3d ptT = ln0.PointAt(t);//

    // Outputs
    L = ln0;
    Pt = ptT;


    //--------------------------------------------------------------------

    // Codition to close the Polyline
    if (close)
    {
      points.Add(points[0]);
    }

    // First Polyline
    Polyline poly = new Polyline(points);



    Print("Polyline Length is = " + poly.Length.ToString());                     // Polyline Length
    Print("Thenumber of segments are: " + poly.SegmentCount.ToString());         // Number of segments
    Print("The Number of Points are: " + poly.Count.ToString());                 // Number of Points

    //------------------------------------------------------------------------------------------------

    // Declare and initialize an empty array in C#
    Line[] lines = new Line[]{};

    List <Point3d> newPoints = new List <Point3d>();
    List <Polyline> newPolylines = new List <Polyline>();
    newPolylines.Add(poly);

    // second empty Polyline
    Polyline newPoly = new Polyline();

    //--------------------------------------------------------------


    int nRepetitions = n; //4;

    for (int j = 0; j < nRepetitions; j++) //
    {
      // Get all the segments lines of the polyline into the array of lines
      lines = poly.GetSegments();

      for (int i = 0 ; i < poly.SegmentCount; i++)// poly.Count-1
      {
        // Print("I find line " + i.ToString());
        newPoints.Add(lines[i].PointAt(t));

        // Condition for minimum segement Length
        if (lines[i].Length <= 1.0)
        {
          break;
        }
      }

      if (close)
      {
        newPoints.Add(newPoints[0]);
      }

      newPoly = new Polyline(newPoints);
      newPolylines.Add(newPoly);

      // Condition to check if we have just one line segment!
      if (newPoly.SegmentCount == 1)
      {
        break;
      }


      poly = newPoly;
      newPoints.Clear();

    }


    // Outputs
    P = poly;
    Lns = lines; //lines[0];//
    newPts = newPoints;
    newPly = newPoly;

    A = newPolylines;

    //--------------------------------------------------------------------
# ---------- end c_script_9 ----------
line_10 = Line(c_script_9.L)
crv_9 = Curve(c_script_9.A)
pt_9 = Point(c_script_9.Pt)

crv_10 = Curve(c_script_9.P)
crv_11 = Curve(c_script_9.Lns)
pt_10 = Point(c_script_9.newPts)
crv_12 = Curve(c_script_9.newPly)
len_2 = Length(Curve=crv_10)
panel_17 = Panel([c_script_9.L, c_script_9.Pt, c_script_9.P, c_script_9.newPts, c_script_9.newPly, c_script_9.A])
panel_18 = Panel(c_script_9.out)
