# Grasshopper definition labADC-RecursiveFunction_python.gh (Grasshopper 1.0.7)

number_slider = Slider(14, range=0..20)
number_slider_2 = Slider(0.65, range=0..1)
crv = Curve(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)

ghpython_script = GhPythonScript(polyline=crv, t=number_slider_2, n=number_slider)  # -> out, A; inputs polyline: Polyline, n: Int32
# ---------- ghpython_script: Python ----------
import rhinoscriptsyntax as rs
import Rhino.Geometry as rg



def PolySubdivision(initialPolyline, repetitions, t):
    
    
    polylines = []
    if t > 1:
        t = 1.00
    elif t < 0:
        t = 0.00
    
    polylines.append(initialPolyline)
    firstPolyline = initialPolyline
    
    ptSegment = []
    
    nPolySegments = initialPolyline.Count -1
    print(nPolySegments)
    
    for k in range(0, repetitions):
        #print(k)
        
        
        #Segments Array
        rSegments = nPolySegments
        rSegments = firstPolyline.GetSegments()
        
        
        #Point3d Segments
        for j in range(0, len(rSegments)):
            #print(j)
            ptSegment.append(rSegments[j].PointAt(t))
            #print(ptSegment)
        ptSegment.append(ptSegment[0])
        
        #Draw the Polyline
        secondPoly = rg.Polyline(ptSegment)
        #print(secondPoly)
        
        #Add the new Polyline to the list
        polylines.append(secondPoly)
        
        #Update the first Polyline
        firstPolyline = secondPoly
        
        #Clearthe list of points
        ptSegment.Clear()
    return polylines


A = PolySubdivision(polyline, n, t)
# ---------- end ghpython_script ----------
curve = Curve(ghpython_script.A)

c_script = CSharpScript(polyline=crv, t=number_slider_2, n=number_slider)  # -> out, A; inputs polyline: Polyline, t: Double, n: Int32
# ---------- c_script: C# ----------
    A = PolySubdivision(polyline, n, t);
# ---------- c_script: C# additional code ----------
  // C# code by Andres Obregon

  List<Polyline> PolySubdivision (Polyline initialPolyline, int repetitions, double t)
  {
    // Empty List to collect the Polylines
    List < Polyline > polylines = new List<Polyline> ();
    if(t > 1){t = 1;} if (t < 0){t = 0;} //t (0.0 to 1.0)
    polylines.Add(initialPolyline);
    Polyline firstPolyline = initialPolyline;

    List<Point3d> ptSegment = new List<Point3d>();

    int nPolySegments = initialPolyline.Count - 1;
    Print(nPolySegments.ToString());

    for (int k = 0; k < repetitions ; k++)
    {


      // Segments Array
      Line [] rSegments = new Line [nPolySegments];
      rSegments = firstPolyline.GetSegments();


      // Point3d Segments
      for (int j = 0; j < rSegments.Length; j++)
      {
        //Print("segement");
        ptSegment.Add(rSegments[j].PointAt(t));
        // Add first Point to close the Polyline
      }

      ptSegment.Add(ptSegment[0]); // ClosePolyline

      // Draw the Polyline
      Polyline secondPoly = new Polyline(ptSegment);
      // Add the new Polyline to the List
      polylines.Add(secondPoly);
      // Update the firt Polyline
      firstPolyline = secondPoly;
      //Clear the list of points
      ptSegment.Clear();

    }


    return polylines;
  }
# ---------- end c_script ----------
crv_2 = Curve(c_script.A)
panel = Panel(curve)
panel_2 = Panel(crv_2)
panel_3 = Panel(c_script.out)
panel_4 = Panel(ghpython_script.out)
